# Grasshopper definition main_building_grid_with_pipes_optionb.ghx (Grasshopper 1.0.7)
# plug-ins: PancakeSpreadsheet, LunchBox, NGon

number_slider = Slider(0.001, range=0..0.001)  # disabled
crv = Curve([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])
mesh = Mesh(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)
stairs_cells = Curve([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])
couryards_cells = Curve([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])
crv_2 = Curve([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])
crv_3 = Curve([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])
crv_4 = Curve([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])
brep = Brep([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])
brep_2 = Brep([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])
curve = Curve(Tree({0}: [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], {1}: [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], {2}: [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]))

# ---- group: Stairs / Target box
crv_5 = Curve([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])  # disabled
partition = PartitionList(List=crv_5, Size=2)  # disabled
disc = Discontinuity(Curve=partition, Level=1)  # -> simplify(Points), Parameters; disabled
trim = TrimTree(Tree=disc.Points, Depth=1)  # disabled
item = ListItem(List=trim, Index=0, Wrap=True)  # -> Item, Item1, Item2, Item3, Item4, Item5, Item6, Item7; disabled
tbox = TwistedBox(
    CornerA=item.Item,
    CornerB=item.Item1,
    CornerC=item.Item2,
    CornerD=item.Item3,
    CornerE=item.Item4,
    CornerF=item.Item5,
    CornerG=item.Item6,
    CornerH=item.Item7)  # disabled

# ----
ramp = Brep(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)  # disabled
# Excel Sheet
# Check the sections
crv_6 = Curve([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])

# ---- group: Stairs / Non distorted box
number_slider_2 = Slider(1, range=0..10)  # disabled
crv_7 = Curve([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])  # disabled
disc_2 = Discontinuity(Curve=crv_7, Level=1)  # -> simplify(Points), Parameters; disabled
shift = ShiftList(List=disc_2.Points, Shift=number_slider_2, Wrap=True)  # disabled
item_2 = ListItem(List=flatten(shift), Index=0, Wrap=True)  # -> Item, Item1, Item2, Item3, Item4, Item5, Item6, Item7; disabled
tbox_2 = TwistedBox(
    CornerA=item_2.Item,
    CornerB=item_2.Item1,
    CornerC=item_2.Item2,
    CornerD=item_2.Item3,
    CornerE=item_2.Item4,
    CornerF=item_2.Item5,
    CornerG=item_2.Item6,
    CornerH=item_2.Item7)  # disabled

# ----
midpt = CurveMiddle(Curve=flatten([crv_2, crv]))  # -> flatten(Midpoint)
midpt_2 = CurveMiddle(Curve=flatten([crv_3, crv_4]))  # -> flatten(Midpoint)
scale = Scale(Geometry=ramp, Center=Point(0, 0, 0), Factor=number_slider)  # -> Geometry, Transform; disabled
c_script = CSharpScript(
    axes=curve,
    volume=mesh,
    stair_positions=stairs_cells,
    courtyard_positions=couryards_cells,
    center_of_diagonals_u=midpt,
    center_of_diagonals_v=midpt_2,
    column_thickness="0.4",
    beam_thickness="0.4",
    long_offset_0="0.3",
    long_offset_1="0.6",
    temp_short_beams_helper_0=brep,
    temp_short_beams_helper_1=brep_2,
    Reference="C:\USERS\PETRA\DESKTOP\Annen_V2\NGons\NGonsCore.dll")  # -> out, floor_meshes, stair_outlines, columns, grids, slab_beams, offset_beams, plates_lines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; inputs axes: tree of Polyline, volume: Mesh, stair_positions: list of Line, courtyard_positions: list of Line, center_of_diagonals_u: list of Point3d, center_of_diagonals_v: list of Point3d, column_thickness: Double, beam_thickness: Double, long_offset_0: Double, long_offset_1: Double, long_edge_offset_0: Double, long_edge_offset_1: Double, temp_short_beams_helper_0: list of Surface, temp_short_beams_helper_1: list of Surface
# ---------- c_script: C# usings ----------
using NGonsCore;
using System.Linq;
# ---------- c_script: C# ----------
    //Create grid
    GridPhanomena grid_phanomena = new GridPhanomena(
      _axes,
      _volume,
      _stair_positions,
      _courtyard_positions,
      _center_of_diagonals_u,
      _center_of_diagonals_v,
      _column_thickness,
      _beam_thickness,
      _long_offset_0,
      _long_offset_1);


    // get grid
    DataTree<Polyline> grids = get_grid_from_axes(_axes, _volume);

    //get columns
    DataTree<Line> columns = get_columns(_axes, _volume);

    // get slab beam
    DataTree<Line> slab_beams = get_slab_beams(_axes, _volume, _long_edge_offset_0, _long_edge_offset_1);

    // get beams
    DataTree<Line> plates_lines = new DataTree<Line>();
    DataTree<Line> offset_beams = get_beams(_axes, _volume, _long_edge_offset_0, _long_edge_offset_1, _temp_short_beams_helper_0, _temp_short_beams_helper_1, ref plates_lines);

    // mesh node system

    /////////////////////////////////////////////////////////////////////////////////////////////////////////////////////////////////////////////
    // Node
    // --- get current floor mesh
    // -*- get neighbors of a current vertex
    // --- get u and v direction of a mesh
    // --- get long edges, and construct short green beams
    // --- get short edges, and construct long green beams
    /////////////////////////////////////////////////////////////////////////////////////////////////////////////////////////////////////////////

    var lines_u = new List<Line>();
    for(int i = 0; i < 2; i++){
      // --- get current floor mesh
      Mesh floor = grid_phanomena.floor_meshes[i + 1].DuplicateMesh();


      // --- get u and v direction of a mesh
      bool[] u_or_v = new bool[0];
      warp_weft(floor, ref u_or_v);

      // --- get_beams_light_green

      int[] ids = Enumerable.Range(0, floor.TopologyVertices.Count).ToArray();
      double offset_distance = 0.45 * 0.5 + 0.3 * 0.5;
      foreach(var id in ids)
        get_beams_light_green(floor, id, u_or_v, offset_distance, 0.8, ref lines_u);
    }





    B = lines_u;

    //
    //    public Polyline bot;
    //    public Polyline top;
    //    public Line[] vertical_lines;
    //D = grid_phanomena.meshes_boxes[1][0].vertical_lines;


    //gather outputs
    DataTree<Line> output_dark_green_beam = new DataTree<Line>();
    DataTree<Line> output_dark_green_beam_secondary = new DataTree<Line>();
    DataTree<Line> output_dark_green_beam_borders = new DataTree<Line>();
    DataTree<Polyline> output_slab = new DataTree<Polyline>();
    DataTree<Polyline> output_slab_beams = new DataTree<Polyline>();
    for (int i = 0; i < grid_phanomena.meshes_boxes.Count; i++)
    {
      for (int j = 0; j < grid_phanomena.meshes_boxes[i].Count; j++)
      {

        output_dark_green_beam.AddRange(grid_phanomena.meshes_boxes[i][j].dark_green_beam, new GH_Path(i));
        output_dark_green_beam_secondary.AddRange(grid_phanomena.meshes_boxes[i][j].dark_green_beam_secondary, new GH_Path(i));
        output_dark_green_beam_borders.AddRange(grid_phanomena.meshes_boxes[i][j].dark_green_beam_borders, new GH_Path(i));
        output_slab.AddRange(grid_phanomena.meshes_boxes[i][j].slab, new GH_Path(i));
        output_slab_beams.AddRange(grid_phanomena.meshes_boxes[i][j].slab_beams, new GH_Path(i));

      }
    }

    //output
    __columns = columns;
    __grids = grids;
    __slab_beams = slab_beams;
    __plates_lines = plates_lines;
    __offset_beams = offset_beams;
    __floor_meshes = grid_phanomena.floor_meshes;
    __stair_outlines = grid_phanomena.stair_outlines;
    __output_dark_green_beam = output_dark_green_beam;
    __output_dark_green_beam_secondary = output_dark_green_beam_secondary;
    __output_dark_green_beam_borders = output_dark_green_beam_borders;
    __output_slab = output_slab;
    __output_slab_beams = output_slab_beams;
# ---------- c_script: C# additional code ----------
  void get_beams_dark_green(Mesh floor, List<bool> mesh_stripes, ref List<Line> lines_v){

    Polyline[] polylines = NGonsCore.MeshUtilSimple.GetFacePolylines(floor).ToArray();

    for(int i = 0; i < polylines.Length; i++){

      int[] faces_vertices = floor.TopologyVertices.IndicesFromFace(i);
      Line side0 = new Line(polylines[i][1], polylines[i][2]);
      Line side1 = new Line(polylines[i][0], polylines[i][3]);

      int sign = mesh_stripes[i] ? -1 : 1;



      Line edge_line = new Line(polylines[i][0], polylines[i][1]);
      Vector3d translation_vector = Vector3d.CrossProduct(Vector3d.ZAxis, edge_line.Direction);
      translation_vector.Unitize();
      translation_vector *= 0.4 * sign;
      edge_line.Transform(Transform.Translation(translation_vector));


      lines_v.Add(edge_line);
      int edge = floor.TopologyEdges.GetEdgeIndex(faces_vertices[2], faces_vertices[3]);
      if(floor.TopologyEdges.GetConnectedFaces(edge).Length == 1){
        edge_line = new Line(polylines[i][3], polylines[i][2]);
        edge_line.Transform(Transform.Translation(translation_vector));
        lines_v.Add(edge_line);
      }


    }



  }

  void get_beams_light_green(Mesh floor, int vertex, bool[] u_or_v, double offset_distance, double vertical_offset, ref List<Line> lines_u){


    // --- get neighbors of a current vertex
    List<int> vertex_neighbors = new List<int>();

    int[] vertex_edges = floor.TopologyVertices.ConnectedEdges(vertex);

    var vertex_neighbors_u = new List<int>();
    var vertex_neighbors_v = new List<int>();
    for(int i = 0; i < vertex_edges.Length; i++){
      Rhino.IndexPair pair = floor.TopologyEdges.GetTopologyVertices(vertex_edges[i]);
      int vertex_neighbor = pair.I == vertex ? pair.J : pair.I;
      if(u_or_v[vertex_edges[i]]){
        // lines_u.Add(floor.TopologyEdges.EdgeLine(vertex_edges[i]));
        vertex_neighbors_u.Add(vertex_neighbor);
      }
      else{
        //lines_v.Add(floor.TopologyEdges.EdgeLine(vertex_edges[i]));
        vertex_neighbors_v.Add(vertex_neighbor);
      }
    }

    // --- get long edges, and construct short green beams and move them side-ways
    Vector3d v = new Vector3d();
    List<double> distances = new List<double>();
    foreach(var n_v in vertex_neighbors_u){
      Vector3d dir = floor.TopologyVertices[n_v] - floor.TopologyVertices[vertex];
      double l = (dir.Length - 8.5) / 2;
      //l = Math.Max(3.5, l);
      distances.Add(l);
      dir.Unitize();
      if(v.Length != 0)
        dir *= -1;
      v += dir;
    }
    v.Unitize();
    //double distance = 3.5;

    //v *= distance;

    double d0 = Math.Max(3.49, (double) distances[0]);
    double d1 = Math.Max(3.49, (double) distances[1 % distances.Count]);
    //Rhino.RhinoApp.WriteLine(d0.ToString() + " " + d1.ToString());
    // d0 = 3.49;
    //d1 = 3.49;

    Line short_light_green_beam = new Line(
      (Point3d) floor.TopologyVertices[vertex] + v * d0,
      (Point3d) floor.TopologyVertices[vertex] - v * d1);


    //    Line short_light_green_beam = new Line(
    //      (Point3d) floor.TopologyVertices[vertex] + v * (double)  distances[0],
    //      (Point3d) floor.TopologyVertices[vertex] - v * (double) distances[1 % distances.Count]);

    //    if(distances[0] > 3.5 || distances[1 % distances.Count] > 3.5){
    //      Rhino.RhinoDoc.ActiveDoc.Objects.AddLine(short_light_green_beam);
    //    }
    //
    //    Line short_light_green_beam = new Line(
    //      (Point3d) floor.TopologyVertices[vertex] + v * 3.5,
    //      (Point3d) floor.TopologyVertices[vertex] - v *3.5);

    //vertical offset
    Line line = new Line(Point3d.Origin, Point3d.Origin + floor.Normals[vertex]);
    double t;
    Rhino.Geometry.Intersect.Intersection.LinePlane(line, new Plane(new Point3d(0, 0, vertical_offset), Vector3d.ZAxis), out t);
    Vector3d vertical_offset_dir = -(Vector3d) line.PointAt(t);
    short_light_green_beam.Transform(Transform.Translation(vertical_offset_dir));

    //copy the line and move sideways two times
    Line short_light_green_beam_0 = short_light_green_beam;
    Line short_light_green_beam_1 = short_light_green_beam;
    Vector3d move_dir = (Point3d) floor.TopologyVertices[vertex] - (Point3d) floor.TopologyVertices[vertex_neighbors_v[0]];
    move_dir.Unitize();
    move_dir *= offset_distance;
    short_light_green_beam_0.Transform(Transform.Translation(move_dir));
    short_light_green_beam_1.Transform(Transform.Translation(-move_dir));
    lines_u.Add(short_light_green_beam_0);
    lines_u.Add(short_light_green_beam_1);

    // --- get short edges, and construct long green beams

  }

  void warp_weft(Mesh mesh, ref  bool[] u_or_v)
  {


    mesh.Vertices.CombineIdentical(true, true);
    mesh.TopologyVertices.SortEdges();

    int[] numArray = new int[mesh.TopologyEdges.Count];
    bool[] flagArray = new bool[mesh.TopologyEdges.Count];
    bool[] flagArray1 = new bool[mesh.TopologyEdges.Count];
    int num = 0;
    int num1 = 0;
    int num2 = 0;

    while (true)
    {
      if (num2 >= mesh.TopologyEdges.Count)
      {
        break;
      }
      else if ((int) mesh.TopologyEdges.GetConnectedFaces(num2).Length != 2)
      {
        num2++;
      }
      else
      {
        numArray[num2] = 1;
        flagArray[num2] = true;
        num = 1;
        break;
      }
    }

    while (num < mesh.TopologyEdges.Count && num1 < mesh.TopologyEdges.Count)
    {
      int num3 = 0;
      int num4 = 0;
      while (num4 < mesh.TopologyEdges.Count)
      {
        if (!flagArray[num4] || flagArray1[num4] || (int) mesh.TopologyEdges.GetConnectedFaces(num4).Length != 2)
        {
          num4++;
        }
        else
        {
          num3 = num4;
          break;
        }
      }

      IndexPair topologyVertices = mesh.TopologyEdges.GetTopologyVertices(num3);
      int i = topologyVertices.I;
      topologyVertices = mesh.TopologyEdges.GetTopologyVertices(num3);
      int j = topologyVertices.J;

      int length = (int) mesh.TopologyVertices.ConnectedTopologyVertices(i).Length;
      for (int i1 = 0; i1 < length; i1++)
      {
        int num5 = mesh.TopologyVertices.ConnectedTopologyVertices(i)[i1];
        if (num3 == mesh.TopologyEdges.GetEdgeIndex(i, num5))
        {
          int num6 = (i1 + 1) % length;
          int num7 = mesh.TopologyVertices.ConnectedTopologyVertices(i)[num6];
          int edgeIndex = mesh.TopologyEdges.GetEdgeIndex(i, num7);
          if (!flagArray[edgeIndex])
          {
            if (numArray[num3] != 0)
            {
              numArray[edgeIndex] = 0;
            }
            else
            {
              numArray[edgeIndex] = 1;
            }
            flagArray[edgeIndex] = true;
            num++;
          }
          int num8 = (i1 - 1 + length) % length;
          int num9 = mesh.TopologyVertices.ConnectedTopologyVertices(i)[num8];
          int edgeIndex1 = mesh.TopologyEdges.GetEdgeIndex(i, num9);
          if (!flagArray[edgeIndex1])
          {
            if (numArray[num3] != 0)
            {
              numArray[edgeIndex1] = 0;
            }
            else
            {
              numArray[edgeIndex1] = 1;
            }
            flagArray[edgeIndex1] = true;
            num++;
          }
        }
      }
      length = (int) mesh.TopologyVertices.ConnectedTopologyVertices(j).Length;
      for (int j1 = 0; j1 < length; j1++)
      {
        int num10 = mesh.TopologyVertices.ConnectedTopologyVertices(j)[j1];
        if (num3 == mesh.TopologyEdges.GetEdgeIndex(j, num10))
        {
          int num11 = (j1 + 1) % length;
          int num12 = mesh.TopologyVertices.ConnectedTopologyVertices(j)[num11];
          int edgeIndex2 = mesh.TopologyEdges.GetEdgeIndex(j, num12);
          if (!flagArray[edgeIndex2])
          {
            if (numArray[num3] != 0)
            {
              numArray[edgeIndex2] = 0;
            }
            else
            {
              numArray[edgeIndex2] = 1;
            }
            flagArray[edgeIndex2] = true;
            num++;
          }
          int num13 = (j1 - 1 + length) % length;
          int num14 = mesh.TopologyVertices.ConnectedTopologyVertices(j)[num13];
          int edgeIndex3 = mesh.TopologyEdges.GetEdgeIndex(j, num14);
          if (!flagArray[edgeIndex3])
          {
            if (numArray[num3] != 0)
            {
              numArray[edgeIndex3] = 0;
            }
            else
            {
              numArray[edgeIndex3] = 1;
            }
            flagArray[edgeIndex3] = true;
            num++;
          }
        }
      }
      flagArray1[num3] = true;
      num1++;
    }
    List<Line> lines = new List<Line>();
    List<Line> lines1 = new List<Line>();
    List<int> lines0_id = new List<int>();
    List<int> lines1_id = new List<int>();
    List<bool> flags = new List<bool>();
    List<bool> flags1 = new List<bool>();
    u_or_v = new bool[mesh.TopologyEdges.Count];
    for (int k = 0; k < mesh.TopologyEdges.Count; k++)
    {
      if (numArray[k] != 0)
      {
        lines1.Add(mesh.TopologyEdges.EdgeLine(k));
        lines0_id.Add(k);
        u_or_v[k] = true;
        if ((int) mesh.TopologyEdges.GetConnectedFaces(k).Length != 2)
        {
          flags1.Add(true);
        }
        else
        {
          flags1.Add(false);
        }
      }
      else
      {
        lines.Add(mesh.TopologyEdges.EdgeLine(k));
        u_or_v[k] = false;
        lines1_id.Add(k);
        if ((int) mesh.TopologyEdges.GetConnectedFaces(k).Length != 2)
        {
          flags.Add(true);
        }
        else
        {
          flags.Add(false);
        }
      }
    }
    //    DA.SetDataList(0, lines);
    //    DA.SetDataList(1, lines1);
    //    DA.SetDataList(2, flags);
    //    DA.SetDataList(3, flags1);
  }

  class GridBox{

    // input

    public int id;
    public bool even_stripe = false;
    public bool even_even_stripe = false;
    public bool odd_strip_face_that_has_vertex_connected_to_oneface = false;
    public Polyline bot;
    public Polyline top;
    public Line[] vertical_lines;

    // output
    public List<Line> dark_green_beam = new List<Line>();
    public List<Line> dark_green_beam_secondary = new List<Line>();
    public List<Line> dark_green_beam_borders = new List<Line>();
    public List<Polyline> slab = new List<Polyline>();
    public List<Polyline> slab_beams = new List<Polyline>();

    Polyline get_section(double z){

      Plane plane = new Plane(new Point3d(0, 0, bot[0].Z + z), Vector3d.ZAxis);
      Polyline section = new Polyline();
      foreach(Line vertical_line in vertical_lines){
        double t;
        Rhino.Geometry.Intersect.Intersection.LinePlane(vertical_line, plane, out t);
        section.Add(vertical_line.PointAt(t));
      }
      section.Add(section[0]);
      return section;

    }

    public Line intersect_line_and_two_lines(ref Line side0, ref Line side1, ref Line edge_line, double offset = 0.4, double scale = 1, double rotation = 0.0, bool by_middle_line_or_perpendicular_line = true){

      //copy
      Line copy_line_ = edge_line;


      // move by middle line, not the perpednicular line
      //      Point3d mid0 = (side0.From + side1.From) * 0.5;
      //      Point3d mid1 = (side0.To + side1.To) * 0.5;
      //      Vector3d translation_vector = mid0 - mid1;
      //      translation_vector.Unitize();
      //      translation_vector *= offset;
      //      copy_line_.Transform(Transform.Translation(translation_vector));


      if(by_middle_line_or_perpendicular_line){
        Point3d mid0 = (side0.From + side1.From) * 0.5;
        Point3d mid1 = (side0.To + side1.To) * 0.5;
        Vector3d translation_vector = mid0 - mid1;
        translation_vector.Unitize();
        translation_vector *= offset;
        copy_line_.Transform(Transform.Translation(translation_vector));
      }else{
        //        Vector3d translation_vector = Vector3d.CrossProduct(Vector3d.ZAxis, copy_line_.Direction);
        //        translation_vector.Unitize();
        //        translation_vector *= offset;
        //        copy_line_.Transform(Transform.Translation(translation_vector));
      }
      //
      //      }else{
      //        //move by the perpendicular line

      //      }


      //intersect
      double t0, t1;
      Rhino.Geometry.Intersect.Intersection.LineLine(side0, copy_line_, out t0, out t1, 0.01, false);
      Point3d p0 = side0.PointAt(t0);
      Rhino.Geometry.Intersect.Intersection.LineLine(side1, copy_line_, out t0, out t1, 0.01, false);
      Point3d p1 = side1.PointAt(t0);
      Line intersection_line = new Line(p0, p1);

      //intersection_line.Extend(extend, extend);
      intersection_line.Transform(Transform.Scale(intersection_line.Center(), scale));
      intersection_line.Transform(Transform.Rotation(rotation, (p0 + p1) * 0.5));


      return intersection_line;

    }

    public void get_beams_dark_green(ref Mesh floor, double z = 4.5, double offset = 0.4, double scale = 2.1){

      Polyline section = get_section(z);


      Line side0 = new Line(section[1], section[2]);
      Line side1 = new Line(section[0], section[3]);
      double local_offset = 0.3;
      double l = (Math.Max(side0.Length, side1.Length) - 8.5) * 0.5;
      if(!even_even_stripe){
        //l += local_offset;
      }
      int sign = even_stripe ? -1 : 1;




      //Rhino.RhinoApp.WriteLine(odd_strip_face_that_has_vertex_connected_to_oneface.ToString());






      //create the edge line and move by intersection
      Line edge_line = new Line(section[0], section[1]);
      dark_green_beam.Add(intersect_line_and_two_lines(ref side0, ref side1, ref edge_line, offset * sign, 1.3));
      int[] faces_vertices = floor.TopologyVertices.IndicesFromFace(id);

      if(even_stripe || true){

        //front
        int front_edge = floor.TopologyEdges.GetEdgeIndex(faces_vertices[0], faces_vertices[1]);
        if(floor.TopologyEdges.GetConnectedFaces(front_edge).Length != 1) {

          dark_green_beam_secondary.Add(intersect_line_and_two_lines(ref side0, ref side1, ref edge_line, -l - sign * local_offset, scale * 0 + 1 + 0.25, -0.00));
        }

        dark_green_beam_secondary.Add(intersect_line_and_two_lines(ref side0, ref side1, ref edge_line, -l - sign * local_offset, scale * 0 + 1 + 0.25, 0.00));

      }


      // one valence vertices of odd rows
      if(odd_strip_face_that_has_vertex_connected_to_oneface)
        if(even_even_stripe){
          //  dark_green_beam_borders.Add(intersect_line_and_two_lines(ref side0, ref side1, ref edge_line, -l - 0.5, scale - 0.8, -0.00));
        }
        else{
          // dark_green_beam_borders.Add(intersect_line_and_two_lines(ref side0, ref side1, ref edge_line, -l, scale - 0.8, -0.00));
        }



      //second time -> intersection of one line with two other lines


      int edge = floor.TopologyEdges.GetEdgeIndex(faces_vertices[2], faces_vertices[3]);
      edge_line = new Line(section[3], section[2]);


      if(even_stripe || true){
        dark_green_beam_secondary.Add(intersect_line_and_two_lines(ref side0, ref side1, ref edge_line, l + sign * local_offset * -1, scale * 0 + 1 + 0.25, 0.00));
      }



      if(floor.TopologyEdges.GetConnectedFaces(edge).Length == 1) {
        // dark_green_beam.Add(intersect_line_and_two_lines(ref side0, ref side1, ref edge_line, offset * sign, 1.3));
      }


      // one valence vertices of odd rows
      if(odd_strip_face_that_has_vertex_connected_to_oneface)
        if(even_even_stripe){
          //dark_green_beam_borders.Add(intersect_line_and_two_lines(ref side0, ref side1, ref edge_line, l + 0.5, scale - 0.8, -0.00));
        }
        else{
          //dark_green_beam_borders.Add(intersect_line_and_two_lines(ref side0, ref side1, ref edge_line, l, scale - 0.8, -0.00));
        }



    }


    void get_edge(){

    }

    public void get_panel(double z = 0.042 ){
      slab.Add(get_section(5));
      slab.Add(get_section(5 - z));
    }

    public  void get_slab_beams(double z = 0.042, double height = 0.28, double width = 0.12, double step = 0.52){
      Polyline section0 = get_section(5 - z);
      Polyline section1 = get_section(5 - z - height);
      Line side0 = section0.SegmentAt(0);
      Line side1 = section0.SegmentAt(2);
      Line side0_ = section1.SegmentAt(0);
      Line side1_ = section1.SegmentAt(2);

      Line mid_line = new Line(side0.PointAt(0.5), side1.PointAt(0.5));
      double[] distances_to_the_mid_line = new double[]{
        mid_line.ClosestPoint(side0.From, false).DistanceTo(side0.From),
        mid_line.ClosestPoint(side0.To, false).DistanceTo(side0.To),
        mid_line.ClosestPoint(side1.From, false).DistanceTo(side1.From),
        mid_line.ClosestPoint(side1.To, false).DistanceTo(side1.To)
        };
      Array.Sort(distances_to_the_mid_line);
      double smallest_dist = distances_to_the_mid_line[0];
      int count = (int) Math.Floor(smallest_dist / step) * 2;
      smallest_dist = count * step * 0.5 - step;

      Vector3d offset_dir = Vector3d.CrossProduct(Vector3d.ZAxis, mid_line.Direction);
      offset_dir.Unitize();
      offset_dir *= smallest_dist;
      mid_line.Transform(Transform.Translation(offset_dir));
      offset_dir.Unitize();

      Vector3d[] volumetric_line_translation = new Vector3d[]{
        offset_dir * width * 0.5,
        -offset_dir * width * 0.5,
        -offset_dir * width * 0.5 - Vector3d.ZAxis * height,
        offset_dir * width * 0.5 - Vector3d.ZAxis * height,
        };

      for(int i = 0; i < count - 1;i++){


        Line mid_line_0 = mid_line;
        mid_line_0.Transform(Transform.Translation(-offset_dir * step * i + volumetric_line_translation[0]));
        mid_line_0 = intersect_line_and_two_lines(ref side0, ref side1, ref mid_line_0, 0, 0, 0);

        if(this.id == 10) {
          Rhino.RhinoDoc.ActiveDoc.Objects.AddLine(side0);
          Rhino.RhinoDoc.ActiveDoc.Objects.AddLine(side1);
          Rhino.RhinoDoc.ActiveDoc.Objects.AddLine(mid_line);
          Rhino.RhinoDoc.ActiveDoc.Objects.AddLine(mid_line_0);
        }


        Line mid_line_1 = mid_line;
        mid_line_1.Transform(Transform.Translation(-offset_dir * step * i + volumetric_line_translation[1]));
        mid_line_1 = intersect_line_and_two_lines(ref side0, ref side1, ref mid_line_1, 0, 0, 0);


        Line mid_line_2 = mid_line;
        mid_line_2.Transform(Transform.Translation(-offset_dir * step * i + volumetric_line_translation[2]));
        mid_line_2 = intersect_line_and_two_lines(ref side0_, ref side1_, ref mid_line_2, 0, 0, 0);


        Line mid_line_3 = mid_line;
        mid_line_3.Transform(Transform.Translation(-offset_dir * step * i + volumetric_line_translation[3]));
        mid_line_3 = intersect_line_and_two_lines(ref side0_, ref side1_, ref mid_line_3, 0, 0, 0);


        Polyline rect0 = new Polyline(new Point3d[]{mid_line_0.From,mid_line_1.From,mid_line_2.From,mid_line_3.From,mid_line_0.From});
        Polyline rect1 = new Polyline(new Point3d[]{mid_line_0.To,mid_line_1.To,mid_line_2.To,mid_line_3.To,mid_line_0.To});
        //Rhino.RhinoDoc.ActiveDoc.Objects.AddPolyline(rect0) ;
        slab_beams.Add(rect0);
        slab_beams.Add(rect1);
      }




    }



  }

  class GridPhanomena {

    /////////////////////////////////////////////////////////////////////////////////////////////////////////////////////////////////////////////
    // properties
    /////////////////////////////////////////////////////////////////////////////////////////////////////////////////////////////////////////////

    //input
    List<List<Polyline>> axes = new List<List<Polyline>>(); // polyline axes of the full grid
    int u,v = 0; // one axis length
    Mesh volume = new Mesh(); // volume that is used to remove the grid rectangles
    List<Point3d> center_of_diagonals_u = new List<Point3d>();
    List<Point3d> center_of_diagonals_v = new List<Point3d>();
    List<Line> stairs_positions = new List<Line>();
    List<Line> courtyard_positions = new List<Line>();
    double column_thickness, beam_thickness, long_offset_0, long_offset_1;

    //inner data-structures
    public List<List<bool>> meshes_stripes = new List<List<bool>>();
    public List<Mesh> floor_meshes = new List<Mesh>(); // multiple floors
    public List<List<Point3d>> floor_meshes_face_centers = new List<List<Point3d>>();
    public List<List<GridBox>> meshes_boxes = new List<List<GridBox>>();


    List<List<List<int>>> columns_of_grid = new List<List<List<int>>>(); // indices of grid that represents the columns

    //output
    public List<Polyline> stair_outlines = new List<Polyline>(); //grid of boxes
    public List<Polyline> columns = new List<Polyline>();
    public List<Polyline> beams_short = new List<Polyline>();
    public List<Polyline> beams_long = new List<Polyline>();
    public List<Polyline> slab = new List<Polyline>();

    /////////////////////////////////////////////////////////////////////////////////////////////////////////////////////////////////////////////
    // constructor
    /////////////////////////////////////////////////////////////////////////////////////////////////////////////////////////////////////////////

    public GridPhanomena(
      DataTree<Polyline> _axes,
      Mesh _volume,
      List<Line> _stairs_positions,
      List<Line> _courtyard_positions,
      List<Point3d> _center_of_diagonals_u,
      List<Point3d> _center_of_diagonals_v,
      double _column_thickness,
      double _beam_thickness,
      double _long_offset_0,
      double _long_offset_1
    ){


      //set properties

      for(int i = 0; i < _axes.BranchCount; i++){
        this.axes.Add(_axes.Branch(i));
      }

      this.u = this.axes[0][0].Count;
      this.v = this.axes[0].Count;

      this.volume = _volume;
      this.stairs_positions = _stairs_positions;
      this.courtyard_positions = _courtyard_positions;
      this.center_of_diagonals_u = _center_of_diagonals_u;
      this.center_of_diagonals_v = _center_of_diagonals_v;
      this.column_thickness = _column_thickness;
      this.beam_thickness = _beam_thickness;
      this.long_offset_0 = _long_offset_0;
      this.long_offset_1 = _long_offset_1;

      //init methods
      get_mesh();
      get_stairs();



      int count = 1;
      foreach(List<GridBox> mesh_boxes in meshes_boxes){
        Mesh floor_mesh = floor_meshes[count];
        floor_mesh.Weld(0.01);
        //floor_mesh.Clean();
        foreach(GridBox mesh_box in mesh_boxes){
          mesh_box.get_beams_dark_green(ref floor_mesh);
          mesh_box.get_panel();
          mesh_box.get_slab_beams();

        }
        count++;
      }
    }

    /////////////////////////////////////////////////////////////////////////////////////////////////////////////////////////////////////////////
    // methods
    /////////////////////////////////////////////////////////////////////////////////////////////////////////////////////////////////////////////

    public void get_mesh(){

      //iterate floors
      for(int i = 0; i < axes.Count; i++){

        Mesh floor_mesh = new Mesh();
        List<bool> mesh_stripes = new List<bool>();
        if(i != 0)
          meshes_boxes.Add(new List<GridBox>());

        // add axes vertices to the mesh
        for(int j = 0; j < axes[i].Count; j++){
          floor_mesh.Vertices.AddVertices(axes[i][j]);

          //normals are the column directions
          for(int k = 0; k < axes[i][j].Count; k++){
            Vector3d vertex_normal = axes[1][j][k] - axes[0][j][k];
            floor_mesh.Normals.Add(vertex_normal);
          }






        }// j

        // add faces to the mesh
        floor_meshes_face_centers.Add(new List<Point3d>(u * v));
        for(int j = 0; j < axes[i].Count - 1; j++){

          for(int k = 0; k < axes[i][j].Count - 1; k++){//

            // skip points that are not inside the mesh
            Point3d center = ((Point3d) floor_mesh.Vertices[(j) *u + (k)] + (Point3d) floor_mesh.Vertices[(j + 1) * u + (k + 1)]) * 0.5;
            floor_meshes_face_centers[i].Add(center);
            if(i != 0)
              if(!volume.IsPointInside(center, 0.01, true))
                continue;

            // add mesh faces
            floor_mesh.Faces.AddFace(
              (j) *u + (k),
              (j) *u + (k + 1),
              (j + 1) * u + (k + 1),
              (j + 1) * u + (k)
              );

            // add boolean flag for the longituadinal axes
            mesh_stripes.Add(k % 2 == 0);

            if(i == 0)
              continue;

            bool odd_strip_face_that_has_vertex_connected_to_oneface_ = k % 2 == 1;




            //create boxes
            //public List<GridBox> meshes_boxes = new List<GridBox>();
            this.meshes_boxes[i - 1].Add(new GridBox(){

                //id = floor_mesh.Faces.Count - 1,
                id = floor_mesh.Faces.Count,
                even_stripe = k % 2 == 0,
                even_even_stripe = k / 2 % 2 == 0,



                top = new Polyline(new Point3d[]{
                floor_mesh.Vertices[(j) *u + (k)],
                floor_mesh.Vertices[(j) *u + (k + 1)],
                floor_mesh.Vertices[(j + 1) * u + (k + 1)],
                floor_mesh.Vertices[(j + 1) * u + (k)],
                floor_mesh.Vertices[(j) *u + (k)],
                }),

                bot = new Polyline(new Point3d[]{
                floor_meshes[i - 1].Vertices[(j) *u + (k)],
                floor_meshes[i - 1].Vertices[(j) *u + (k + 1)],
                floor_meshes[i - 1].Vertices[(j + 1) * u + (k + 1)],
                floor_meshes[i - 1].Vertices[(j + 1) * u + (k)],
                floor_meshes[i - 1].Vertices[(j) *u + (k)],
                }),

                vertical_lines = new Line[]{
                new Line(floor_meshes[i - 1].Vertices[(j) *u + (k)], floor_mesh.Vertices[(j) *u + (k)]),
                new Line(floor_meshes[i - 1].Vertices[(j) *u + (k + 1)], floor_mesh.Vertices[(j) *u + (k + 1)]),
                new Line(floor_meshes[i - 1].Vertices[(j + 1) * u + (k + 1)], floor_mesh.Vertices[(j + 1) * u + (k + 1)]),
                new Line(floor_meshes[i - 1].Vertices[(j + 1) * u + (k)], floor_mesh.Vertices[(j + 1) * u + (k)]),

                }

                });


          }//k
        }// j

        floor_meshes.Add(floor_mesh);

        if(i == 0)
          continue;

        //Rhino.RhinoApp.WriteLine(this.meshes_boxes.Count.ToString());

        //var a = this.meshes_boxes[this.meshes_boxes.Count-1];

        for(int j = 0; j < floor_mesh.Faces.Count; j++){

          int[] face_vertices = new int[]{
            floor_mesh.Faces[j].A,
            floor_mesh.Faces[j].B,
            floor_mesh.Faces[j].C,
            floor_mesh.Faces[j].D
            };

          for(int k = 0; k < 4; k++){
            int[] vertex_faces = floor_mesh.TopologyVertices.ConnectedFaces(face_vertices[k]);
            if(vertex_faces.Length == 1){



              if( !this.meshes_boxes[this.meshes_boxes.Count - 1][j].even_stripe ) {
                this.meshes_boxes[this.meshes_boxes.Count - 1][j].odd_strip_face_that_has_vertex_connected_to_oneface = true;
              }

              break;
            }

          }

        }



        meshes_stripes.Add(mesh_stripes);
      }// i



    }

    public void get_stairs(){

      stair_outlines = new List<Polyline>(stairs_positions.Count * 2);

      for(int i = 0; i < floor_meshes.Count; i++){

        //iterate mesh faces and check stair line exists

        for(int j = 0; j < floor_meshes[i].Faces.Count ; j++){



          foreach (Line stair_line in stairs_positions){

            //Rhino.RhinoApp.WriteLine((stair_line.ClosestPoint(floor_meshes_face_centers[i][j], false).DistanceTo(floor_meshes_face_centers[i][j]) ).ToString());
            if(stair_line.PointAt(0.5).DistanceTo(floor_meshes_face_centers[i][j]) < 0.2){

              // Rhino.RhinoDoc.ActiveDoc.Objects.AddPoint(floor_meshes_face_centers[i][j]);

              Polyline bottom_rect = new Polyline(new Point3d[]{
                floor_meshes[i].Vertices[floor_meshes[i].Faces[j].A],
                floor_meshes[i].Vertices[floor_meshes[i].Faces[j].B],
                floor_meshes[i].Vertices[floor_meshes[i].Faces[j].C],
                floor_meshes[i].Vertices[floor_meshes[i].Faces[j].D],
                floor_meshes[i].Vertices[floor_meshes[i].Faces[j].A]

                });


              stair_outlines.Add(bottom_rect);

              //Rhino.RhinoApp.WriteLine((stair_line.ClosestPoint(floor_meshes_face_centers[i][j], false).DistanceTo(floor_meshes_face_centers[i][j]) ).ToString());

              break;
            }
          }

        }



      }
    }

    public void get_ramp(){

    }

    public void get_hand_rails(){

    }

    public void get_slabs(){
      // strips and strip splits
    }

    public void get_columns_beams_diagonals_slabs(){

    }



  }


  DataTree<Line> get_columns(DataTree<Polyline> _axes, Mesh _volume){


    /////////////////////////////////////////////////////////////////////////////////////////////////////////////////////////////////////////////
    // get number of floors the column is finished
    /////////////////////////////////////////////////////////////////////////////////////////////////////////////////////////////////////////////

    int[][] beam_heights = new int[_axes.Branch(0).Count][];
    //iterate floors
    for(int i = 0; i < _axes.Branch(0).Count; i++){
      beam_heights[i] = new int[_axes.Branch(0)[i].Count];
    }


    //iterate floors
    for(int i = 0; i < _axes.BranchCount;i++){

      //iterate polylines
      for(int j = 0; j < _axes.Branch(i).Count ; j++){//skip the last

        //iterate polyline points
        for(int k = 0; k < _axes.Branch(i)[j].Count ; k++){//skip the last

          Point3d center = _axes[new GH_Path(i), j][k];
          if(!_volume.IsPointInside(center, 0.01, true))
            continue;

          beam_heights[j][k] = i;

        }
      }
    }

    /////////////////////////////////////////////////////////////////////////////////////////////////////////////////////////////////////////////
    // create column
    /////////////////////////////////////////////////////////////////////////////////////////////////////////////////////////////////////////////
    DataTree<Line> columns = new DataTree<Line>();

    //iterate one floor
    for(int i = 0; i < 1; i++){

      //iterate polylines
      for(int j = 0; j < _axes.Branch(i).Count ; j++){//skip the last

        // the columns are movec along the axes
        Vector3d move_vec = _axes.Branch(i)[j][1] - _axes.Branch(i)[j][0];
        Line line = new Line(_axes.Branch(i)[j][0], _axes.Branch(i)[j][1]);

        // Rhino.RhinoDoc.ActiveDoc.Objects.AddPolyline(_axes.Branch(i)[j] );
        // Rhino.RhinoDoc.ActiveDoc.Objects.AddLine(line);
        move_vec.Unitize();
        move_vec *= 0.45 * 0.5 + 0.3 * 0.5;

        //iterate polyline points
        for(int k = 0; k < _axes.Branch(i)[j].Count; k++){//skip the last

          int id = beam_heights[j][k];

          // main column

          Line column = new Line(_axes[new GH_Path(i), j][k], _axes[new GH_Path(id), j][k]);

          // side column 1 | move vector is the axis line
          Line column_moved_0 = column;
          column_moved_0.Transform(Transform.Translation(move_vec));

          // side column 2
          Line column_moved_1 = column;
          column_moved_1.Transform(Transform.Translation(-move_vec));



          columns.Add(column, new GH_Path(0));
          //          columns.Add(column_moved_0, new GH_Path(1));
          //          columns.Add(column_moved_1, new GH_Path(1));


        }
      }
    }


    /////////////////////////////////////////////////////////////////////////////////////////////////////////////////////////////////////////////
    // create side columns
    /////////////////////////////////////////////////////////////////////////////////////////////////////////////////////////////////////////////
    double height = 4.6;
    double radius = 0.2;
    double[] heights = new double[]{
      0.5,
      5 - (5 - height) ,
      5 - (5 - height) + radius ,
      10 - (5 - height)};

    //iterate one floor
    for(int i = 0; i < 2; i++){

      //iterate polylines
      for(int j = 0; j < _axes.Branch(i).Count ; j++){//skip the last

        // the columns are movec along the axes
        Vector3d move_vec = _axes.Branch(i)[j][1] - _axes.Branch(i)[j][0];
        Line line = new Line(_axes.Branch(i)[j][0], _axes.Branch(i)[j][1]);






        // Rhino.RhinoDoc.ActiveDoc.Objects.AddPolyline(_axes.Branch(i)[j] );
        // Rhino.RhinoDoc.ActiveDoc.Objects.AddLine(line);
        move_vec.Unitize();
        move_vec *= 0.45 * 0.5 + 0.3 * 0.5;

        //iterate polyline points
        for(int k = 0; k < _axes.Branch(i)[j].Count; k++){//skip the last

          int id = beam_heights[j][k];



          // main column

          Line column = new Line(_axes[new GH_Path(i), j][k], _axes[new GH_Path(id), j][k]);

          if(!_volume.IsPointInside(column.PointAt(1.0), 0.01, true))
            continue;

          Plane plane_0 = new Plane(new Point3d(0, 0, heights[i * 2]), Vector3d.ZAxis);
          Plane plane_1 = new Plane(new Point3d(0, 0, heights[i * 2 + 1]), Vector3d.ZAxis);
          column = new Line (NGonsCore.PlaneUtil.LinePlane(column, plane_0), NGonsCore.PlaneUtil.LinePlane(column, plane_1));

          // side column 1 | move vector is the axis line
          Line column_moved_0 = column;
          column_moved_0.Transform(Transform.Translation(move_vec));

          // side column 2
          Line column_moved_1 = column;
          column_moved_1.Transform(Transform.Translation(-move_vec));



          //columns.Add(column, new GH_Path(0));
          columns.Add(column_moved_0, new GH_Path(1));
          columns.Add(column_moved_1, new GH_Path(1));


        }
      }
    }


    return columns;
  }

  DataTree<Polyline> get_grid_from_axes(DataTree<Polyline> _axes, Mesh _volume){
    DataTree<Polyline> grids = new DataTree<Polyline>();

    //iterate floors
    for(int i = 0; i < _axes.BranchCount;i++){

      //iterate polylines
      for(int j = 0; j < _axes.Branch(i).Count - 1; j++){//skip the last

        //iterate pollyine points
        for(int k = 0; k < _axes.Branch(i)[j].Count - 1; k++){//skip the last

          Point3d center = 0.5 * (_axes[new GH_Path(i), j][k] + _axes[new GH_Path(i), j + 1][k + 1]);

          if(!_volume.IsPointInside(center, 0.01, true))
            continue;

          Polyline rectangle = new Polyline(){
              _axes[new GH_Path(i), j][k],
              _axes[new GH_Path(i), j][k + 1],
              _axes[new GH_Path(i), j + 1][k + 1],
              _axes[new GH_Path(i), j + 1][k],
              _axes[new GH_Path(i), j][k],
              };
          grids.Add(rectangle, new GH_Path(i));


        }

      }

    }

    return grids;
  }

  DataTree<Line> get_slab_beams(DataTree<Polyline> _axes, Mesh _volume, double _long_edge_offset_0, double _long_edge_offset_1){
    DataTree<Line> center_lines = new DataTree<Line>();

    //iterate floors
    for(int i = 0; i < _axes.BranchCount;i++){

      //iterate polylines
      for(int j = 0; j < _axes.Branch(i).Count - 1; j++){//skip the last

        //iterate pollyine points
        for(int k = 0; k < _axes.Branch(i)[j].Count - 1; k++){//skip the last

          Point3d center = 0.5 * (_axes[new GH_Path(i), j][k] + _axes[new GH_Path(i), j + 1][k + 1]);

          if(!_volume.IsPointInside(center, 0.01, true))
            continue;


          //long edges
          Line line_00 = new Line(_axes[new GH_Path(i), j][k], _axes[new GH_Path(i), j + 1][k]);
          Line line_01 = new Line(_axes[new GH_Path(i), j][k + 1], _axes[new GH_Path(i), j + 1][k + 1]);


          //short edges
          Line line_10 = new Line(_axes[new GH_Path(i), j][k], _axes[new GH_Path(i), j][k + 1]);
          Line line_11 = new Line(_axes[new GH_Path(i), j + 1][k], _axes[new GH_Path(i), j + 1][k + 1]);

          /////////////////////////////////////////////////////////////////////////////////////////////////////////////////////////////////////////////
          //measure the distance between the centers
          /////////////////////////////////////////////////////////////////////////////////////////////////////////////////////////////////////////////

          //OK - measure the mid distance
          Line line_mid = new Line(line_00.PointAt(0.5), line_01.PointAt(0.5));
          Vector3d vector_mid = line_mid.Direction;
          double inclined_mid_distance = vector_mid.Length - 5;
          vector_mid.Unitize();

          //measure the _long_edge_offset_0_dist project to orthogonal distance
          Line line_perp = new Line(line_00.PointAt(0.5), line_01.ClosestPoint(line_00.PointAt(0.5), false));
          Vector3d vector_perp = line_perp.Direction;
          vector_perp.Unitize();
          vector_perp *= _long_edge_offset_0;
          double _long_edge_offset_0_dist = _long_edge_offset_0 / Math.Cos(Vector3d.VectorAngle(vector_mid, vector_perp));

          //project to perp axis
          double _long_edge_offset_1_ = inclined_mid_distance - _long_edge_offset_0_dist;
          line_mid = new Line(line_01.PointAt(0.5), line_00.PointAt(0.5));
          line_perp = new Line(line_01.PointAt(0.5), line_00.ClosestPoint(line_01.PointAt(0.5), false));
          _long_edge_offset_1_ = _long_edge_offset_1_ * Math.Cos(Vector3d.VectorAngle(vector_mid, vector_perp));
          _long_edge_offset_1_ += 0.04;
          _long_edge_offset_1_ = Math.Max(_long_edge_offset_1_, _long_edge_offset_1);


          //move long edges inside and interesect with side lines
          Vector3d z_axis_0 = Vector3d.CrossProduct(line_00.Direction, Vector3d.ZAxis);
          Vector3d z_axis_1 = Vector3d.CrossProduct(line_01.Direction, Vector3d.ZAxis);
          z_axis_0.Unitize();
          z_axis_1.Unitize();
          bool offset_flag = k % 2 == 0;
          offset_flag = j % 2 == 0 ? offset_flag : !offset_flag;
          z_axis_0 *= !offset_flag ? _long_edge_offset_0 : _long_edge_offset_1_;
          z_axis_1 *= !offset_flag ? _long_edge_offset_1_ : _long_edge_offset_0;
          Plane plane_00 = new Plane(line_00.From - z_axis_0, z_axis_0);
          Plane plane_01 = new Plane(line_01.From + z_axis_1, z_axis_1);

          double t100;
          Rhino.Geometry.Intersect.Intersection.LinePlane(line_10, plane_00, out t100);

          double t110;
          Rhino.Geometry.Intersect.Intersection.LinePlane(line_11, plane_00, out t110);

          double t101;
          Rhino.Geometry.Intersect.Intersection.LinePlane(line_10, plane_01, out t101);

          double t111;
          Rhino.Geometry.Intersect.Intersection.LinePlane(line_11, plane_01, out t111);

          Line line_00_ = new Line(line_10.PointAt(t100), line_11.PointAt(t110));
          Line line_01_ = new Line(line_10.PointAt(t101), line_11.PointAt(t111));









          Line line_0_mid = new Line(line_00_.PointAt(0.5), line_01_.PointAt(0.5));
          Line line_0_perp = new Line(line_00_.PointAt(0.5), line_01_.ClosestPoint(line_00_.PointAt(0.5), false));
          //center_lines.Add(line_0_perp, new GH_Path(i));
          center_lines.Add(line_0_mid, new GH_Path(i));
          // center_lines.Add(line_00_, new GH_Path(i));
          //center_lines.Add(line_01_, new GH_Path(i));



        }

      }

    }

    return center_lines;
  }

  DataTree<Line> get_beams(DataTree<Polyline> _axes, Mesh _volume, double _long_edge_offset_0, double _long_edge_offset_1, List<Surface> _temp_short_beams_helper_0, List<Surface> _temp_short_beams_helper_1, ref DataTree<Line> plates_lines){
    DataTree<Line> offset_beams = new DataTree<Line>();


    //iterate floors
    for(int i = 0; i < _axes.BranchCount;i++){

      //iterate polylines
      for(int j = 0; j < _axes.Branch(i).Count - 1; j++){//skip the last

        //long beams iterate polyline points
        for(int k = 0; k < _axes.Branch(i)[j].Count - 1; k++){//skip the last

          Point3d center = 0.5 * (_axes[new GH_Path(i), j][k] + _axes[new GH_Path(i), j + 1][k + 1]);
          if(!_volume.IsPointInside(center, 0.01, true))
            continue;


          //long edges
          Line line_00 = new Line(_axes[new GH_Path(i), j][k], _axes[new GH_Path(i), j + 1][k]);
          Line line_01 = new Line(_axes[new GH_Path(i), j][k + 1], _axes[new GH_Path(i), j + 1][k + 1]);


          //short edges
          Line line_10 = new Line(_axes[new GH_Path(i), j][k], _axes[new GH_Path(i), j][k + 1]);
          Line line_11 = new Line(_axes[new GH_Path(i), j + 1][k], _axes[new GH_Path(i), j + 1][k + 1]);

          //OK - measure the mid distance
          Line line_mid = new Line(line_00.PointAt(0.5), line_01.PointAt(0.5));
          Vector3d vector_mid = line_mid.Direction;
          double inclined_mid_distance = vector_mid.Length - 5;
          vector_mid.Unitize();

          //measure the _long_edge_offset_0_dist project to orthogonal distance
          Line line_perp = new Line(line_00.PointAt(0.5), line_01.ClosestPoint(line_00.PointAt(0.5), false));
          Vector3d vector_perp = line_perp.Direction;
          vector_perp.Unitize();
          vector_perp *= _long_edge_offset_0;
          double _long_edge_offset_0_dist = _long_edge_offset_0 / Math.Cos(Vector3d.VectorAngle(vector_mid, vector_perp));

          //project to perp axis
          double _long_edge_offset_1_ = inclined_mid_distance - _long_edge_offset_0_dist;
          line_mid = new Line(line_01.PointAt(0.5), line_00.PointAt(0.5));
          line_perp = new Line(line_01.PointAt(0.5), line_00.ClosestPoint(line_01.PointAt(0.5), false));
          _long_edge_offset_1_ = _long_edge_offset_1_ * Math.Cos(Vector3d.VectorAngle(vector_mid, vector_perp));
          _long_edge_offset_1_ += 0.04;
          _long_edge_offset_1_ = Math.Max(_long_edge_offset_1_, _long_edge_offset_1);


          //move long edges inside and interesect with side lines
          Vector3d z_axis_0 = Vector3d.CrossProduct(line_00.Direction, Vector3d.ZAxis);
          Vector3d z_axis_1 = Vector3d.CrossProduct(line_01.Direction, Vector3d.ZAxis);
          z_axis_0.Unitize();
          z_axis_1.Unitize();
          bool offset_flag = k % 2 == 0;
          offset_flag = j % 2 == 0 ? offset_flag : !offset_flag;
          z_axis_0 *= !offset_flag ? _long_edge_offset_0 : _long_edge_offset_1_;
          z_axis_1 *= !offset_flag ? _long_edge_offset_1_ : _long_edge_offset_0;
          Plane plane_00 = new Plane(line_00.From - z_axis_0, z_axis_0);
          Plane plane_01 = new Plane(line_01.From + z_axis_1, z_axis_1);



          double t100;
          Rhino.Geometry.Intersect.Intersection.LinePlane(line_10, plane_00, out t100);

          double t110;
          Rhino.Geometry.Intersect.Intersection.LinePlane(line_11, plane_00, out t110);

          double t101;
          Rhino.Geometry.Intersect.Intersection.LinePlane(line_10, plane_01, out t101);

          double t111;
          Rhino.Geometry.Intersect.Intersection.LinePlane(line_11, plane_01, out t111);

          Vector3d z_axis_offset = Vector3d.ZAxis * -0.15;

          Line line_00_ = new Line(line_10.PointAt(t100) + z_axis_offset, line_11.PointAt(t110) + z_axis_offset);
          Line line_01_ = new Line(line_10.PointAt(t101) + z_axis_offset, line_11.PointAt(t111) + z_axis_offset);

          /////////////////////////////////////////////////////////////////////////////////////////////////////////////////////////////////////////////
          // divide beams to create the slab
          /////////////////////////////////////////////////////////////////////////////////////////////////////////////////////////////////////////////
          double length = Math.Min(line_10.Length, line_11.Length);
          double length_0 = line_11.PointAt(0.0).DistanceTo(line_10.ClosestPoint(line_11.PointAt(0.0), false));
          double length_1 = line_11.PointAt(1.0).DistanceTo(line_10.ClosestPoint(line_11.PointAt(1.0), false));
          length = Math.Min(length_0, length_1);
          double divisions = length / 0.25;
          Point3d[] pts0;
          line_00.ToNurbsCurve().DivideByCount((int) Math.Floor(length / 0.25) - 1, false, out pts0);
          Point3d[] pts1;
          line_01.ToNurbsCurve().DivideByCount((int) Math.Floor(length / 0.25) - 1, false, out pts1);
          if(pts0.Length > 10){
            for(int z = 0; z < pts0.Length;z++ ){
              plates_lines.Add(new Line(pts0[z], pts1[z]), new GH_Path(new int[]{i,j,k}));
            }
          }


          line_00_.Extend(0.75, 0.75);
          line_01_.Extend(0.75, 0.75);
          offset_beams.Add(line_00_, new GH_Path(i));
          offset_beams.Add(line_01_, new GH_Path(i));




        }

        //short beams
        for(int k = 0; k < _axes.Branch(i)[j].Count - 1; k++){//skip the last

          Point3d center = 0.5 * (_axes[new GH_Path(i), j][k] + _axes[new GH_Path(i), j + 1][k + 1]);
          if(!_volume.IsPointInside(center, 0.01, true))
            continue;


          //long edges
          Line line_10 = new Line(_axes[new GH_Path(i), j][k], _axes[new GH_Path(i), j + 1][k]);
          Line line_11 = new Line(_axes[new GH_Path(i), j][k + 1], _axes[new GH_Path(i), j + 1][k + 1]);


          //short edges
          Line line_00 = new Line(_axes[new GH_Path(i), j][k], _axes[new GH_Path(i), j][k + 1]);
          Line line_01 = new Line(_axes[new GH_Path(i), j + 1][k], _axes[new GH_Path(i), j + 1][k + 1]);




          /////////////////////////////////////////////////////////////////////////////////////////////////////////////////////////////////////////////
          //measure the distance between the centers
          /////////////////////////////////////////////////////////////////////////////////////////////////////////////////////////////////////////////


          //OK - measure the mid distance
          Line line_mid = new Line(line_10.PointAt(0.5), line_11.PointAt(0.5));
          Vector3d vector_mid = line_mid.Direction;
          double inclined_mid_distance = vector_mid.Length - 5;
          vector_mid.Unitize();

          //measure the _long_edge_offset_0_dist project to orthogonal distance
          Line line_perp = new Line(line_10.PointAt(0.5), line_11.ClosestPoint(line_00.PointAt(0.5), false));
          Vector3d vector_perp = line_perp.Direction;
          vector_perp.Unitize();
          vector_perp *= _long_edge_offset_0;
          double _long_edge_offset_0_dist = _long_edge_offset_0 / Math.Cos(Vector3d.VectorAngle(vector_mid, vector_perp));

          //project to perp axis
          double _long_edge_offset_1_ = inclined_mid_distance - _long_edge_offset_0_dist;
          line_mid = new Line(line_11.PointAt(0.5), line_10.PointAt(0.5));
          line_perp = new Line(line_11.PointAt(0.5), line_10.ClosestPoint(line_11.PointAt(0.5), false));
          _long_edge_offset_1_ = _long_edge_offset_1_ * Math.Cos(Vector3d.VectorAngle(vector_mid, vector_perp));
          _long_edge_offset_1_ += 0.04;
          _long_edge_offset_1_ = Math.Max(_long_edge_offset_1_, _long_edge_offset_1);


          //move long edges inside and interesect with side lines
          Vector3d z_axis_0 = Vector3d.CrossProduct(line_00.Direction, Vector3d.ZAxis);
          Vector3d z_axis_1 = Vector3d.CrossProduct(line_01.Direction, Vector3d.ZAxis);
          z_axis_0.Unitize();
          z_axis_1.Unitize();
          bool offset_flag = k % 2 == 0;
          offset_flag = j % 2 == 0 ? offset_flag : !offset_flag;
          z_axis_0 *= !offset_flag ? _long_edge_offset_0 : _long_edge_offset_0;
          z_axis_1 *= !offset_flag ? _long_edge_offset_0 : _long_edge_offset_0;
          Plane plane_00 = new Plane(line_00.From - z_axis_0, z_axis_0);
          Plane plane_01 = new Plane(line_01.From + z_axis_1, z_axis_1);

          //temp closest point search defined manually
          bool corner_case_0 = false;
          foreach(Surface s in _temp_short_beams_helper_0){
            double u,v;
            s.ClosestPoint(center, out u, out v);
            if(s.PointAt(u, v).DistanceTo(center) < 0.01){
              corner_case_0 = true;
              break;
            }
          }

          bool corner_case_1 = false;
          foreach(Surface s in _temp_short_beams_helper_1){
            double u,v;
            s.ClosestPoint(center, out u, out v);
            if(s.PointAt(u, v).DistanceTo(center) < 0.01){
              corner_case_1 = true;
              break;
            }
          }

          if(corner_case_0){
            plane_00 = new Plane(line_00.From + z_axis_0, z_axis_0);
            plane_01 = new Plane(line_01.From + z_axis_1, z_axis_1);
          }

          if(corner_case_1){
            plane_00 = new Plane(line_00.From - z_axis_0, z_axis_0);
            plane_01 = new Plane(line_01.From - z_axis_1, z_axis_1);
          }

          double t100;
          Rhino.Geometry.Intersect.Intersection.LinePlane(line_10, plane_00, out t100);

          double t110;
          Rhino.Geometry.Intersect.Intersection.LinePlane(line_11, plane_00, out t110);

          double t101;
          Rhino.Geometry.Intersect.Intersection.LinePlane(line_10, plane_01, out t101);

          double t111;
          Rhino.Geometry.Intersect.Intersection.LinePlane(line_11, plane_01, out t111);


          Vector3d z_axis_offset = Vector3d.ZAxis * -0.3;
          Line line_00_ = new Line(line_10.PointAt(t100) + z_axis_offset, line_11.PointAt(t110) + z_axis_offset);
          Line line_01_ = new Line(line_10.PointAt(t101) + z_axis_offset, line_11.PointAt(t111) + z_axis_offset);






          double extension_value = _long_edge_offset_1_ + 1.50;
          line_00_.Extend(extension_value, extension_value);
          line_01_.Extend(extension_value, extension_value);



          if(corner_case_0 || corner_case_1){
            offset_beams.Add(line_00_, new GH_Path(i));
            offset_beams.Add(line_01_, new GH_Path(i));
          }else{
            if(k % 2 == 0){
              offset_beams.Add(line_00_, new GH_Path(i));
            }else{
              offset_beams.Add(line_01_, new GH_Path(i));
            }
          }









        }

      }

    }

    return offset_beams;
  }
# ---------- end c_script ----------
item_3 = ListItem(List=c_script.floor_meshes, Index=0, Wrap=True)
cluster = Cluster_5(M=item_3)
number_slider_3 = Slider(0.4, range=0..1)
swatch = ColourSwatch(SwatchColor=RGB(229, 255, 0))
swatch_2 = ColourSwatch(SwatchColor=RGB(60, 66, 52))
swatch_3 = ColourSwatch(SwatchColor=RGB(38, 66, 0))
swatch_4 = ColourSwatch(SwatchColor=RGB(237, 0, 0))

# ---- group: mesh normals are made as axes
demesh = DeconstructMesh(Mesh=c_script.floor_meshes)  # -> Vertices, Faces, Colours, Normals
vdis = VectorDisplay(Anchor=demesh.Vertices, Vector=demesh.Normals)

# ----
relay = Relay([crv_2, crv, crv_3, crv_4])
branch = TreeBranch(Tree=c_script.columns, Path="{1}", MaintainPaths=True)
branch_2 = TreeBranch(Tree=c_script.columns, Path="{0}", MaintainPaths=True)
cluster_2 = Cluster_6(L=c_script.output_slab_beams)
cluster_3 = Cluster_4(L=c_script.output_slab)
cluster_4 = Cluster(T=c_script.output_dark_green_beam, R=0.2, C=swatch_2)
cluster_5 = Cluster(T=c_script.B, R=0.2, C=swatch)
cluster_6 = Cluster(T=c_script.output_dark_green_beam_secondary, R=0.2, C=swatch_3)
cluster_7 = Cluster(T=c_script.output_dark_green_beam_borders, R=0.2, C=ColourSwatch(SwatchColor=RGB(9, 15, 0)))
cluster_8 = Cluster_7(T=relay, R=0.2, C=swatch_4, A=Slider(0.4, range=0..1))
swatch_5 = ColourSwatch(SwatchColor=RGB(255, 255, 255))
swatch_6 = ColourSwatch(SwatchColor=RGB(59, 59, 59))
len = Length(Curve=c_script.B)
line_sdl = LineSDL(Start=demesh.Vertices, Direction=demesh.Normals, Length=10)
midpt_3 = CurveMiddle(Curve=c_script.B)
cluster_9 = Cluster_3(T=branch, R=0.15, M=swatch_6)
cluster_10 = Cluster_2(T=branch_2, R=0.225, C=swatch_5)
larger = LargerThan(FirstNumber=len, SecondNumber=Slider(7, range=0..10))  # -> LargerThan, OrEqualTo
bar_graph = BarGraph(len, BarColor=RGB(255, 0, 90))
cull = CullPattern(List=c_script.B, CullPattern=larger.LargerThan)
midpt_4 = CurveMiddle(Curve=c_script.B)
display = CurvePreview(Curve=cull, Width=Slider(27, range=0..1000))
tag = TextTag3D(Location=midpt_4, Text=len, Size=Slider(1, range=0..10), Justification=7)
number_slider_4 = Slider(0.001, range=0..0.001)  # disabled

# ---- group: Tragkonstruktion_
tragkonstruktion_balken_40_dunkelgrün_b = Relay([c_script.output_dark_green_beam_secondary, c_script.output_dark_green_beam_borders])
clean = CleanTree(RemoveNulls=True, RemoveInvalid=True, RemoveEmpty=invert(False), Tree=branch_2)  # -> flatten(Tree)
clean_2 = CleanTree(RemoveNulls=True, RemoveInvalid=True, RemoveEmpty=invert(False), Tree=branch)  # -> flatten(Tree)
clean_3 = CleanTree(RemoveNulls=True, RemoveInvalid=True, RemoveEmpty=invert(False), Tree=c_script.B)  # -> flatten(Tree)
clean_4 = CleanTree(RemoveNulls=True, RemoveInvalid=True, RemoveEmpty=invert(False), Tree=c_script.columns)  # -> flatten(Tree)
clean_5 = CleanTree(RemoveNulls=True, RemoveInvalid=True, RemoveEmpty=invert(False), Tree=tragkonstruktion_balken_40_dunkelgrün_b)  # -> flatten(Tree)
clean_6 = CleanTree(RemoveNulls=True, RemoveInvalid=True, RemoveEmpty=invert(False), Tree=relay)  # -> flatten(Tree)
len_2 = Length(Curve=clean)
len_3 = Length(Curve=clean_2)
len_4 = Length(Curve=clean_3)
len_5 = Length(Curve=clean_4)
len_6 = Length(Curve=clean_5)
len_7 = Length(Curve=clean_6)
lng = ListLength(List=len_2)
lng_2 = ListLength(List=len_3)
lng_3 = ListLength(List=len_4)
lng_4 = ListLength(List=len_5)
lng_5 = ListLength(List=len_6)
lng_6 = ListLength(List=len_7)
entwine = Entwine(Branch00=lng, Branch01=lng_2, Branch02=lng_3, Branch03=lng_4, Branch04=lng_5, Branch05=lng_6, FlattenInputs=True)  # -> simplify(Result)
panel = Panel("""N Spalte_45 (d | m | m3)
N Spalte_30(d | m | m3)
N Balken_40_hellgrün (d | m | m3)
N Balken_40_dunkelgrün_A (d | m | m3)
N Balken_40_dunkelgrün_B (d | m | m3)
N Diagonalen_40 (d | m | m3)""")
entwine_2 = Entwine(Branch00=len_2, Branch01=len_3, Branch02=len_4, Branch03=len_5, Branch04=len_6, Branch05=len_7, FlattenInputs=True)  # -> simplify(Result)
ma = MassAddition(Input=entwine_2)  # -> Result, PartialResults
c_script_2 = CSharpScript(x=entwine_2)  # -> out, A; inputs x: Double
# ---------- c_script_2: C# ----------
    A = Math.Round(x, 2).ToString();
# ---------- end c_script_2 ----------
panel_2 = Panel("""0.45
0.30
0.40
0.40
0.40
0.40""")
panel_3 = Panel("""Länge (m)
Länge (m)
Länge (m)
Länge (m)
Länge (m)
Länge (m)""")
graft = GraftTree(Tree=panel_2, IncludeEmptyLists=True, IncludeNullItems=True)  # -> simplify(Tree)
graft_2 = GraftTree(Tree=panel, IncludeEmptyLists=True, IncludeNullItems=True)  # -> simplify(Tree)
toggle = BooleanToggle(False)
c_script_3 = CSharpScript(l=simplify(ma.Result), d=simplify(graft))  # -> out, A; inputs l: Double, d: Double
# ---------- c_script_3: C# ----------
    double cylinde_volume = Math.PI * Math.Pow((d / 2), 2) * l;
    
    A = Math.Round(cylinde_volume, 2).ToString();
# ---------- end c_script_3 ----------
graft_3 = GraftTree(Tree=panel_3, IncludeEmptyLists=True, IncludeNullItems=True)  # -> simplify(Tree)
merge = Merge(Data1=graft_2, Data2=graft, Data3=entwine, Data4=c_script_3.A, Data5=graft_3, Data6=c_script_2.A)  # -> simplify(Result)
path = FilePath("C:\IBOIS57\_Code\Software\Phanomena\phanomena\calculation\main_building_grid.xlsx")
pssimplewritetable = SimpleWriteTreeToXLS(
    File=path,
    SheetIdentifier="Tragkonstruktion",
    Data=merge,
    RowFirst=invert(True),
    ResizeColumn=True,
    CreateNew=toggle,
    IgnoreNull=invert(False),
    OK=toggle)

# ----
data = Data([swatch_5, swatch_6, swatch, swatch_2, swatch_3, swatch_4])
entwine_3 = Entwine(
    Branch00=flatten(clean),
    Branch01=flatten(clean_2),
    Branch02=flatten(clean_3),
    Branch03=flatten(clean_4),
    Branch04=flatten(clean_5),
    Branch05=flatten(clean_6),
    FlattenInputs=True)  # -> simplify(Result)
panel_4 = Panel("""Tragkonstruktion_Spalte_45 (m)
Tragkonstruktion_Spalte_30(m)
Tragkonstruktion_Balken_40_hellgrün (m)
Tragkonstruktion_Balken_40_dunkelgrün_A (m)
Tragkonstruktion_Balken_40_dunkelgrün_B (m)
Tragkonstruktion_Diagonalen_40 (m)""")
bake = ObjectBake(
    BakeToggle=Toggle(False),
    GeometryObjects=entwine_3,
    Layer=graft(panel_4),
    ObjectName="GH_Obj",
    ObjectColor=graft(data),
    LayerColor=graft(data))

# ---- group: Stairs
brep_3 = Brep([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])  # disabled
brep_4 = Brep([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])  # disabled
crv_8 = Curve([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])  # disabled
crv_9 = Curve([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])  # disabled

# ---- group: Stairs / Stairs sub structure
number_slider_5 = Slider(2, range=0..10)  # disabled
morph = BoxMorph(Geometry=crv_9, Reference=tbox_2, Target=tbox)  # disabled
line = Line(morph)  # disabled
number_slider_6 = Slider(125, range=0..1000)  # disabled
number_slider_7 = Slider(150, range=0..1000)  # disabled
split = SplitList(List=line, Index=number_slider_5)  # -> ListA, ListB; disabled
pipe = Pipe(Curve=split.ListA, Radius=number_slider_7, Caps=flatten(1))  # -> simplify(Pipe); disabled
pipe_2 = Pipe(Curve=split.ListB, Radius=number_slider_6, Caps=flatten(1))  # -> simplify(Pipe); disabled
trim_2 = TrimTree(Tree=[pipe, pipe_2], Depth=1)  # disabled
sunion = SolidUnion(Breps=trim_2)  # -> graft(Result); disabled

# ---- group: Stairs / Handrail
morph_2 = BoxMorph(Geometry=brep_4, Reference=tbox_2, Target=tbox)  # disabled

# ---- group: Stairs / Steps
morph_3 = BoxMorph(Geometry=brep_3, Reference=tbox_2, Target=tbox)  # -> simplify(graft(Geometry)); disabled
morph_4 = BoxMorph(Geometry=crv_8, Reference=tbox_2, Target=tbox)  # disabled
number_slider_8 = Slider(180, range=0..1000)  # disabled
ext = ExtendCurve(Curve=morph_4, Type=0, Start=1000, End=1000)  # disabled
line_2 = Line(ext)  # disabled
pipe_3 = Pipe(Curve=line_2, Radius=number_slider_8, Caps=1)  # -> simplify(Pipe); disabled
sint = SolidIntersection(BrepsA=morph_3, BrepsB=pipe_3)  # disabled

# ---- group: Stairs (continued)
trim_3 = TrimTree(Tree=sint, Depth=1)  # disabled
group = Group(Objects=[morph_2, trim_3])  # disabled
group_2 = Group(Objects=group)  # disabled

# ----
scale_2 = Scale(Geometry=group_2, Center=Point(0, 0, 0), Factor=number_slider_4)  # -> Geometry, Transform; disabled

# ==== cluster Cluster
R = ClusterInput()
T = ClusterInput()
clean = CleanTree(RemoveNulls=True, RemoveInvalid=True, RemoveEmpty=invert(False), Tree=T)
meshpipe = MeshPipe(Curve=clean, Radius=R, Sides=10, Tolerance=10, Ending=0)
C = ClusterInput()
swatch = ColourSwatch(SwatchColor=RGB(255, 255, 255))
colormesh = ColorMesh(Mesh=meshpipe, Color=C)
preview = CustomPreview(
    Geometry=flatten(meshpipe),
    Material=flatten({diffuse=RGB(221, 160, 221), emission=RGB(66, 48, 66), shine=0.5, specular=RGB(255, 255, 255), transparency=0}))
meshedges = MeshEdges(Mesh=colormesh)  # -> AllE, NakedE
display = CurvePreview(Curve=meshedges.AllE, Width=Slider(1, range=0..1))

# ==== cluster Cluster_2
R = ClusterInput()
T = ClusterInput()
clean = CleanTree(RemoveNulls=True, RemoveInvalid=True, RemoveEmpty=invert(False), Tree=T)
meshpipe = MeshPipe(Curve=clean, Radius=R, Sides=10, Tolerance=10, Ending=0)
C = ClusterInput()
colormesh = ColorMesh(Mesh=meshpipe, Color=C)
meshedges = MeshEdges(Mesh=colormesh)  # -> AllE, NakedE
display = CurvePreview(Curve=meshedges.AllE, Width=Slider(1, range=0..1))

# ==== cluster Cluster_3
R = ClusterInput()
T = ClusterInput()
clean = CleanTree(RemoveNulls=True, RemoveInvalid=True, RemoveEmpty=invert(False), Tree=T)
lng = ListLength(List=clean)
wheel = ColourWheel(
    lng,
    ColourGrips_Style=10,
    ColourGrips_Grip=[1.060050173, 2.094395102, 4.188790205, 3.141592654],
    ColourGrips_Lum=[0.1, 0.6014165268],
    ColourGrips_Range=[0.4092652311, 0.4092652311, 0.4092652311, 0.4092652311],
    ColourGrips_Sat=[0, 0.3603819476])
M = ClusterInput()
meshpipe = MeshPipe(Curve=clean, Radius=R, Sides=10, Tolerance=10, Ending=0)
colormesh = ColorMesh(Mesh=meshpipe, Color=wheel)
meshedges = MeshEdges(Mesh=colormesh)  # -> AllE, NakedE
display = CurvePreview(Curve=meshedges.AllE, Width=Slider(1, range=0..1))

# ==== cluster Cluster_4
L = ClusterInput()
partition = PartitionList(List=L, Size=2)
fromp = FromPolylines(Curves=L, Min_Triangulation=False)
loft = LoftPolylines(Curve0=partition, Fast=invert(True))
meshedges = MeshEdges(Mesh=fromp)  # -> AllE, NakedE
colormesh = ColorMesh(Mesh=loft, Color=ColourSwatch(SwatchColor=RGB(209, 188, 140)))
display = CurvePreview(Curve=meshedges.AllE)

# ==== cluster Cluster_5
M = ClusterInput()
colormesh = ColorMesh(Mesh=M, Color=ColourSwatch(SwatchColor=RGB(255, 255, 255)))
meshedges = MeshEdges(Mesh=M)  # -> AllE, NakedE
display = CurvePreview(Curve=meshedges.AllE)

# ==== cluster Cluster_6
L = ClusterInput()
partition = PartitionList(List=L, Size=2)
loft = LoftPolylines(Curve0=partition, Fast=invert(True))
meshedges = MeshEdges(Mesh=loft)  # -> AllE, NakedE
colormesh = ColorMesh(Mesh=loft, Color=ColourSwatch(SwatchColor=RGB(209, 188, 140)))
display = CurvePreview(Curve=meshedges.AllE)

# ==== cluster Cluster_7
R = ClusterInput()
T = ClusterInput()
clean = CleanTree(RemoveNulls=True, RemoveInvalid=True, RemoveEmpty=invert(False), Tree=T)
line = Line(clean)
Z = UnitZ(Factor=1)
vec = Vector(line)
A = ClusterInput()
xprod = CrossProduct(VectorA=vec, VectorB=Z, Unitize=False)  # -> Vector, Length
amp = Amplitude(Vector=xprod.Vector, Amplitude=A)
move = Move(Geometry=clean, Motion=amp)  # -> Geometry, Transform
meshpipe = MeshPipe(Curve=move.Geometry, Radius=R, Sides=10, Tolerance=10, Ending=0)
C = ClusterInput()
swatch = ColourSwatch(SwatchColor=RGB(255, 255, 255))
colormesh = ColorMesh(Mesh=meshpipe, Color=C)
preview = CustomPreview(
    Geometry=flatten(meshpipe),
    Material=flatten({diffuse=RGB(221, 160, 221), emission=RGB(66, 48, 66), shine=0.5, specular=RGB(255, 255, 255), transparency=0}))
meshedges = MeshEdges(Mesh=colormesh)  # -> AllE, NakedE
display = CurvePreview(Curve=meshedges.AllE, Width=Slider(1, range=0..1))
