# Grasshopper definition phanomena_grid.ghx (Grasshopper 1.0.7)

crv_00 = Curve(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)
crv_01 = Curve(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)
crv_10 = Curve(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)
crv_11 = Curve(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)
pt = Point([Point(572513.0571, 209532.4348, 2851.535629), Point(585322.376, 206732.3601, 2851.535629), Point(564806.3949, 286497.0556, 2851.535629), Point(572548.3928, 283335.3342, 2851.535629), Point(580290.3906, 280173.6128, 2851.535629)])
pt_2 = Point(Point(578266.4966, 208275.075, 2851.535629))
pt_3 = Point([Point(561569.3731, 280409.5163, 2851.535629), Point(563407.7418, 264847.3421, 2851.535629), Point(565134.7964, 249273.2463, 2851.535629), Point(566750.5369, 233687.229, 2851.535629), Point(568254.9632, 218089.2901, 2851.535629), Point(583743.2157, 271441.3952, 2851.535629), Point(583788.9143, 256870.4803, 2851.535629), Point(584383.7374, 242331.6242, 2851.535629), Point(585527.6849, 227824.827, 2851.535629), Point(587220.7567, 213350.0887, 2851.535629)])
pt_4 = Point([Point(495420.6527, 189302.8834, 2550.000001), Point(504150.6674, 175905.8682, 2550.000001), Point(503228.6466, 162026.3605, 2550.000001), Point(478750.4738, 201463.4988, 2550.000001), Point(505819.494, 148551.804, 2550.000001), Point(458363.7383, 211655.7015, 2550.000001)])
pt_5 = Point([Point(510995.3253, 169470.3797, 2550.000001), Point(476574.2325, 193980.008, 2550.000001), Point(489049.0691, 195780.3638, 2550.000001), Point(496798.0315, 168418.7671, 2550.000001), Point(487333.169, 167717.6921, 2550.000001), Point(493205.8109, 181951.4508, 2550.000001)])
crv_00_2 = Curve(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)
crv_01_2 = Curve(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)
crv_10_2 = Curve(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)
crv_11_2 = Curve(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)
c_script = CSharpScript(
    crv_00=crv_00,
    crv_01=crv_01,
    crv_10=crv_10,
    crv_11=crv_11,
    divisions_u=Slider(5, range=0..10),
    divisions_v=Slider(3, range=0..10),
    diagonal_point_short_u=pt,
    diagonal_point_short_v=pt_2,
    diagonal_point_long_v=pt_3,
    diagonal_tolerance=Slider(1000, range=0..1000))  # -> out, columns, beams, diagonals, grid, A; inputs crv_00: Curve, crv_01: Curve, crv_10: Curve, crv_11: Curve, divisions_u: Int32, divisions_v: Int32, diagonal_point_short_u: list of Point3d, diagonal_point_short_v: list of Point3d, diagonal_point_long_u: list of Point3d, diagonal_point_long_v: list of Point3d, diagonal_tolerance: Double
# ---------- c_script: C# usings ----------
using System.Linq;
# ---------- c_script: C# ----------
    /////////////////////////////////////////////////////////////////////////////////////////////////////////////////////////////////////////////
    // description and development notes
    // 2022_02_09 Petras Vestartas commit - "ADD initialize geometry grid"
    /////////////////////////////////////////////////////////////////////////////////////////////////////////////////////////////////////////////
    this.Component.Message = "phanomena_biolab_grid";


    /////////////////////////////////////////////////////////////////////////////////////////////////////////////////////////////////////////////
    // output trees, these datatrees will be outputted from this component
    /////////////////////////////////////////////////////////////////////////////////////////////////////////////////////////////////////////////

    columns = new  DataTree<Line>();
    beams = new  DataTree<Line>();
    diagonals = new  DataTree<Line>();
    grid = new  DataTree<Polyline>();

    /////////////////////////////////////////////////////////////////////////////////////////////////////////////////////////////////////////////
    // column grid
    /////////////////////////////////////////////////////////////////////////////////////////////////////////////////////////////////////////////

    //divide curves into longitudinal axes
    Point3d[] pts_00, pts_01, pts_10, pts_11;
    _crv_00.DivideByCount(_divisions_u, true, out pts_00);
    _crv_01.DivideByCount(_divisions_u, true, out pts_01);
    _crv_10.DivideByCount(_divisions_u, true, out pts_10);
    _crv_11.DivideByCount(_divisions_u, true, out pts_11);

    //create short axes by dividing the bottom points
    Line[] short_axes_0 = new Line[_divisions_u + 1];
    Line[] short_axes_1 = new Line[_divisions_u + 1];
    List<Point3d> display = new List<Point3d>();
    List<Line> display_lines = new List<Line>();

    for(int i = 0; i < _divisions_u + 1; i++){


      //get short axes lines
      short_axes_0[i] = new Line(pts_00[i], pts_01[i]);
      short_axes_1[i] = new Line(pts_10[i], pts_11[i]);

      //get bottom short axes divisions points
      Point3d[] pts_short_0;
      (new Line(pts_00[i], pts_01[i])).ToNurbsCurve().DivideByCount(_divisions_v, true, out pts_short_0);

      //get top short axes divisions points
      Point3d[] pts_short_1;
      (new Line(pts_10[i], pts_11[i])).ToNurbsCurve().DivideByCount(_divisions_v, true, out pts_short_1);


      //get top axes division points by vertica projection used in the restaurant
      //      Point3d[] pts_short_1 = new Point3d[pts_short_0.Length];
      //      pts_short_1[0] = pts_10[i];
      //      pts_short_1[pts_short_1.Length - 1] = pts_11[i];
      //      for(int j = 1; j < _divisions_v; j++){
      //        Line temp_vertical_line = new Line(pts_short_0[j], pts_short_0[j] + Vector3d.ZAxis * 1000);
      //        double t0,t1;
      //        Rhino.Geometry.Intersect.Intersection.LineLine(short_axes_1[i], temp_vertical_line, out t0, out t1, 0.01, false);
      //        pts_short_1[j] = short_axes_1[i].PointAt(t0);
      //      }

      //init columns
      for(int j = 0; j < _divisions_v + 1; j++){
        columns.Add(new Line(pts_short_0[j], pts_short_1[j]), new GH_Path(i));
      }
    }

    /////////////////////////////////////////////////////////////////////////////////////////////////////////////////////////////////////////////
    // init beams
    /////////////////////////////////////////////////////////////////////////////////////////////////////////////////////////////////////////////

    for(int i = 0; i < columns.BranchCount; i++ ){
      for(int j = 0; j < columns.Branch(i).Count - 1;j++){
        Line short_beam = new Line(columns.Branch(i)[j].To, columns.Branch(i)[j + 1].To);
        beams.Add(short_beam, new GH_Path(i, 0));
      }
    }

    for(int i = 0; i < columns.BranchCount - 1; i++ ){
      for(int j = 0; j < columns.Branch(i).Count;j++){
        Line long_beam = new Line(columns.Branch(i)[j].To, columns.Branch(i + 1)[j].To);
        beams.Add(long_beam, new GH_Path(i, 1));
      }
    }
    /////////////////////////////////////////////////////////////////////////////////////////////////////////////////////////////////////////////
    // init diagonals
    /////////////////////////////////////////////////////////////////////////////////////////////////////////////////////////////////////////////

    //facade diagonals
    double t = 0.15;


    //inside diagonals - long

    for(int i = 0; i < columns.BranchCount - 1; i++ ){
      for(int j = 0; j < columns.Branch(i).Count;j++){
        Line long_beam_u = new Line(columns.Branch(i)[j].PointAt(1 - t), columns.Branch(i + 1)[j].PointAt(t));
        Line long_beam_v = new Line(columns.Branch(i)[j].PointAt(t), columns.Branch(i + 1)[j].PointAt(1 - t));

        bool has_diagonal_u = false;
        foreach(Point3d p in _diagonal_point_long_u){
          if(long_beam_u.ClosestPoint(p, false).DistanceTo(p) < _diagonal_tolerance || long_beam_v.ClosestPoint(p, false).DistanceTo(p) < _diagonal_tolerance ){
            has_diagonal_u = true;
            break;
          }
        }
        if(has_diagonal_u)
          diagonals.Add(long_beam_u, new GH_Path(i, 1));

        bool has_diagonal_v = false;
        foreach(Point3d p in _diagonal_point_long_v){
          if(long_beam_u.ClosestPoint(p, false).DistanceTo(p) < _diagonal_tolerance || long_beam_v.ClosestPoint(p, false).DistanceTo(p) < _diagonal_tolerance ){
            has_diagonal_v = true;
            break;
          }
        }
        if(has_diagonal_v)
          diagonals.Add(long_beam_v, new GH_Path(i, 1));
      }
    }

    //inside diagonals - short
    for(int i = 0; i < columns.BranchCount; i++ ){
      for(int j = 0; j < columns.Branch(i).Count - 1;j++){
        Line short_beam_u = new Line(columns.Branch(i)[j].PointAt(1 - t), columns.Branch(i)[j + 1].PointAt(t));
        Line short_beam_v = new Line(columns.Branch(i)[j].PointAt(t), columns.Branch(i)[j + 1].PointAt(1 - t));

        bool has_diagonal_u = false;
        foreach(Point3d p in _diagonal_point_short_u){
          //check both diagonals
          if(short_beam_u.ClosestPoint(p, false).DistanceTo(p) < _diagonal_tolerance || short_beam_v.ClosestPoint(p, false).DistanceTo(p) < _diagonal_tolerance ){
            has_diagonal_u = true;
            break;
          }
        }
        if(has_diagonal_u)
          diagonals.Add(short_beam_u, new GH_Path(i, 1));

        bool has_diagonal_v = false;
        foreach(Point3d p in _diagonal_point_short_v){
          //check both diagonals
          if(short_beam_u.ClosestPoint(p, false).DistanceTo(p) < _diagonal_tolerance || short_beam_v.ClosestPoint(p, false).DistanceTo(p) < _diagonal_tolerance ){
            has_diagonal_v = true;
            break;
          }
        }
        if(has_diagonal_v)
          diagonals.Add(short_beam_v, new GH_Path(i, 1));
      }
    }



    /////////////////////////////////////////////////////////////////////////////////////////////////////////////////////////////////////////////
    // init grid
    /////////////////////////////////////////////////////////////////////////////////////////////////////////////////////////////////////////////
    for(int i = 0; i < columns.BranchCount - 1; i++ ){
      for(int j = 0; j < columns.Branch(i).Count - 1;j++){
        Line short_beam_u = new Line(columns.Branch(i)[j].PointAt(1 - t), columns.Branch(i)[j + 1].PointAt(t));
        Line short_beam_v = new Line(columns.Branch(i)[j].PointAt(t), columns.Branch(i)[j + 1].PointAt(1 - t));

        Polyline rectangle_bottom = new Polyline(
          new Point3d[]{
          columns.Branch(i)[j].From,
          columns.Branch(i + 1)[j].From,
          columns.Branch(i + 1)[j + 1].From,
          columns.Branch(i)[j + 1].From,
          columns.Branch(i)[j].From,
          }
          );

        grid.Add(rectangle_bottom, new GH_Path(i, 0));

        Polyline rectangle_top = new Polyline(
          new Point3d[]{
          columns.Branch(i)[j].To,
          columns.Branch(i + 1)[j].To,
          columns.Branch(i + 1)[j + 1].To,
          columns.Branch(i)[j + 1].To,
          columns.Branch(i)[j].To,
          }
          );

        grid.Add(rectangle_top, new GH_Path(i, 1));

      }

    }



    //output

    __columns = columns;
    __beams = beams;
    __diagonals = diagonals;
    __grid = grid;

    //display
    get_bounding_box_from_datatree();
# ---------- c_script: C# additional code ----------
  BoundingBox bbox;
  DataTree<Line> columns = new  DataTree<Line>();
  DataTree<Line> beams = new  DataTree<Line>();
  DataTree<Line> diagonals = new  DataTree<Line>();
  DataTree<Polyline> grid = new  DataTree<Polyline>();

  /////////////////////////////////////////////////////////////////////////////////////////////////////////////////////////////////////////////
  // bbox for display
  /////////////////////////////////////////////////////////////////////////////////////////////////////////////////////////////////////////////
  void get_bounding_box_from_datatree(){
    bbox = grid.AllData()[0].BoundingBox;
    foreach(var pline in grid.AllData())
      bbox.Union(pline.BoundingBox);
  }

  //Return a BoundingBox that contains all the geometry you are about to draw.
  public override BoundingBox ClippingBox
  {
    get
    {
      return bbox;
    }
  }

  //Draw all meshes in this method.
  public override void DrawViewportMeshes(IGH_PreviewArgs args)
  {
    args.Display.DrawLines(columns.AllData(), System.Drawing.Color.Black, 4);
    args.Display.DrawLines(beams.AllData(), System.Drawing.Color.Red, 4);
    args.Display.DrawLines(diagonals.AllData(), System.Drawing.Color.Blue, 4);
  }
# ---------- end c_script ----------
c_script_2 = CSharpScript(
    crv_00=crv_00_2,
    crv_01=crv_01_2,
    crv_10=crv_10_2,
    crv_11=crv_11_2,
    divisions_u=Slider(5, range=0..10),
    divisions_v=Slider(7, range=0..10),
    diagonal_point_short=pt_4,
    diagonal_point_long=pt_5,
    diagonal_tolerance=Slider(1000, range=0..1000))  # -> out, columns, beams, diagonals, grid, A; inputs crv_00: Curve, crv_01: Curve, crv_10: Curve, crv_11: Curve, divisions_u: Int32, divisions_v: Int32, diagonal_point_short: list of Point3d, diagonal_point_long: list of Point3d, diagonal_tolerance: Double
# ---------- c_script_2: C# ----------
    /////////////////////////////////////////////////////////////////////////////////////////////////////////////////////////////////////////////
    // description and development notes
    // 2022_02_09 Petras Vestartas commit - "ADD initialize geometry grid"
    /////////////////////////////////////////////////////////////////////////////////////////////////////////////////////////////////////////////
    this.Component.Message = "phanomena_restaurant_grid";


    /////////////////////////////////////////////////////////////////////////////////////////////////////////////////////////////////////////////
    // output trees, these datatrees will be outputted from this component
    /////////////////////////////////////////////////////////////////////////////////////////////////////////////////////////////////////////////

     columns = new  DataTree<Line>();
     beams = new  DataTree<Line>();
    diagonals = new  DataTree<Line>();
     grid = new  DataTree<Polyline>();

    /////////////////////////////////////////////////////////////////////////////////////////////////////////////////////////////////////////////
    // column grid
    /////////////////////////////////////////////////////////////////////////////////////////////////////////////////////////////////////////////

    //divide curves into longitudinal axes
    Point3d[] pts_00, pts_01, pts_10, pts_11;
    _crv_00.DivideByCount(_divisions_u, true, out pts_00);
    _crv_01.DivideByCount(_divisions_u, true, out pts_01);
    _crv_10.DivideByCount(_divisions_u, true, out pts_10);
    _crv_11.DivideByCount(_divisions_u, true, out pts_11);

    //create short axes by dividing the bottom points
    Line[] short_axes_0 = new Line[_divisions_u + 1];
    Line[] short_axes_1 = new Line[_divisions_u + 1];
    List<Point3d> display = new List<Point3d>();
    List<Line> display_lines = new List<Line>();

    for(int i = 0; i < _divisions_u + 1; i++){


      //get short axes lines
      short_axes_0[i] = new Line(pts_00[i], pts_01[i]);
      short_axes_1[i] = new Line(pts_10[i], pts_11[i]);

      //get bottom short axes divisions points
      Point3d[] pts_short_0;
      (new Line(pts_00[i], pts_01[i])).ToNurbsCurve().DivideByCount(_divisions_v, true, out pts_short_0);


      //get top axes division points
      Point3d[] pts_short_1 = new Point3d[pts_short_0.Length];
      pts_short_1[0] = pts_10[i];
      pts_short_1[pts_short_1.Length - 1] = pts_11[i];
      for(int j = 1; j < _divisions_v; j++){
        Line temp_vertical_line = new Line(pts_short_0[j], pts_short_0[j] + Vector3d.ZAxis * 1000);
        double t0,t1;
        Rhino.Geometry.Intersect.Intersection.LineLine(short_axes_1[i], temp_vertical_line, out t0, out t1, 0.01, false);
        pts_short_1[j] = short_axes_1[i].PointAt(t0);
      }

      //init columns
      for(int j = 0; j < _divisions_v + 1; j++){
        columns.Add(new Line(pts_short_0[j], pts_short_1[j]), new GH_Path(i));
      }
    }

    /////////////////////////////////////////////////////////////////////////////////////////////////////////////////////////////////////////////
    // init beams
    /////////////////////////////////////////////////////////////////////////////////////////////////////////////////////////////////////////////

    for(int i = 0; i < columns.BranchCount; i++ ){
      for(int j = 0; j < columns.Branch(i).Count - 1;j++){
        Line short_beam = new Line(columns.Branch(i)[j].To, columns.Branch(i)[j + 1].To);
        beams.Add(short_beam, new GH_Path(i, 0));
      }
    }

    for(int i = 0; i < columns.BranchCount - 1; i++ ){
      for(int j = 0; j < columns.Branch(i).Count;j++){
        Line long_beam = new Line(columns.Branch(i)[j].To, columns.Branch(i + 1)[j].To);
        beams.Add(long_beam, new GH_Path(i, 1));
      }
    }
    /////////////////////////////////////////////////////////////////////////////////////////////////////////////////////////////////////////////
    // init diagonals
    /////////////////////////////////////////////////////////////////////////////////////////////////////////////////////////////////////////////

    //facade diagonals
    double t = 0.15;
    for(int i = 0; i < columns.BranchCount - 1; i++ ){
      for(int j = 0; j < columns.Branch(i).Count;j += columns.Branch(i).Count - 1){
        Line long_beam = new Line(columns.Branch(i)[j].PointAt(1 - t), columns.Branch(i + 1)[j].PointAt(t));
        diagonals.Add(long_beam, new GH_Path(i, 1));
      }
    }

    //inside diagonals - long

    for(int i = 0; i < columns.BranchCount - 1; i++ ){
      for(int j = 0; j < columns.Branch(i).Count;j++){
        Line long_beam_u = new Line(columns.Branch(i)[j].PointAt(1 - t), columns.Branch(i + 1)[j].PointAt(t));
        Line long_beam_v = new Line(columns.Branch(i)[j].PointAt(t), columns.Branch(i + 1)[j].PointAt(1 - t));

        bool has_diagonal = false;
        foreach(Point3d p in _diagonal_point_long){
          if(long_beam_u.ClosestPoint(p, false).DistanceTo(p) < _diagonal_tolerance || long_beam_v.ClosestPoint(p, false).DistanceTo(p) < _diagonal_tolerance ){
            has_diagonal = true;
            break;
          }
        }
        if(has_diagonal)
          diagonals.Add(long_beam_u, new GH_Path(i, 1));
      }
    }

    //inside diagonals - short
    for(int i = 0; i < columns.BranchCount; i++ ){
      for(int j = 0; j < columns.Branch(i).Count - 1;j++){
        Line short_beam_u = new Line(columns.Branch(i)[j].PointAt(1 - t), columns.Branch(i)[j + 1].PointAt(t));
        Line short_beam_v = new Line(columns.Branch(i)[j].PointAt(t), columns.Branch(i)[j + 1].PointAt(1 - t));

        bool has_diagonal = false;
        foreach(Point3d p in _diagonal_point_short){
          if(short_beam_u.ClosestPoint(p, false).DistanceTo(p) < _diagonal_tolerance || short_beam_v.ClosestPoint(p, false).DistanceTo(p) < _diagonal_tolerance ){
            has_diagonal = true;
            break;
          }
        }
        if(has_diagonal)
          diagonals.Add(short_beam_u, new GH_Path(i, 1));
      }
    }



    /////////////////////////////////////////////////////////////////////////////////////////////////////////////////////////////////////////////
    // init grid
    /////////////////////////////////////////////////////////////////////////////////////////////////////////////////////////////////////////////
    for(int i = 0; i < columns.BranchCount - 1; i++ ){
      for(int j = 0; j < columns.Branch(i).Count - 1;j++){
        Line short_beam_u = new Line(columns.Branch(i)[j].PointAt(1 - t), columns.Branch(i)[j + 1].PointAt(t));
        Line short_beam_v = new Line(columns.Branch(i)[j].PointAt(t), columns.Branch(i)[j + 1].PointAt(1 - t));

        Polyline rectangle_bottom = new Polyline(
          new Point3d[]{
          columns.Branch(i)[j].From,
          columns.Branch(i + 1)[j].From,
          columns.Branch(i + 1)[j + 1].From,
          columns.Branch(i)[j + 1].From,
          columns.Branch(i)[j].From,
          }
          );

        grid.Add(rectangle_bottom, new GH_Path(i, 0));

        Polyline rectangle_top = new Polyline(
          new Point3d[]{
          columns.Branch(i)[j].To,
          columns.Branch(i + 1)[j].To,
          columns.Branch(i + 1)[j + 1].To,
          columns.Branch(i)[j + 1].To,
          columns.Branch(i)[j].To,
          }
          );

        grid.Add(rectangle_top, new GH_Path(i, 1));

      }

    }





    //output

    __columns = columns;
    __beams = beams;
    __diagonals = diagonals;
    __grid = grid;

    //display
   get_bounding_box_from_datatree();
# ---------- c_script_2: C# additional code ----------
  BoundingBox bbox;
  DataTree<Line> columns = new  DataTree<Line>();
  DataTree<Line> beams = new  DataTree<Line>();
  DataTree<Line> diagonals = new  DataTree<Line>();
  DataTree<Polyline> grid = new  DataTree<Polyline>();

  /////////////////////////////////////////////////////////////////////////////////////////////////////////////////////////////////////////////
  // bbox for display
  /////////////////////////////////////////////////////////////////////////////////////////////////////////////////////////////////////////////
  void get_bounding_box_from_datatree(){
    bbox = grid.AllData()[0].BoundingBox;
    foreach(var pline in grid.AllData())
      bbox.Union(pline.BoundingBox);
  }

  //Return a BoundingBox that contains all the geometry you are about to draw.
  public override BoundingBox ClippingBox
  {
    get
    {
      return bbox;
    }
  }

  //Draw all meshes in this method.
  public override void DrawViewportMeshes(IGH_PreviewArgs args)
  {
    args.Display.DrawLines(columns.AllData(), System.Drawing.Color.Black, 4);
    args.Display.DrawLines(beams.AllData(), System.Drawing.Color.Red, 4);
    args.Display.DrawLines(diagonals.AllData(), System.Drawing.Color.Blue, 4);
  }
# ---------- end c_script_2 ----------
boundary = BoundarySurfaces(Edges=c_script_2.grid)
boundary_2 = BoundarySurfaces(Edges=c_script.grid)
pipe = Pipe(Curve=[c_script_2.columns, c_script_2.beams, c_script_2.diagonals], Radius=150, Caps=0)  # disabled
pipe_2 = Pipe(Curve=[c_script.columns, c_script.beams, c_script.diagonals], Radius=150, Caps=0)  # disabled
