# Grasshopper definition main_building_grid_timber_calculation.ghx (Grasshopper 1.0.7)
# plug-ins: PancakeSpreadsheet, LunchBox, NGon

number_slider = Slider(0.001, range=0..0.001)  # disabled
curve = Curve(Tree({0}: [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], {1}: [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], {2}: [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]))
mesh = Mesh(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)
stairs_cells = Curve([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])
couryards_cells = Curve([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])
diagonals_0 = Curve([<curve referenced from the Rhino model> x50])
diagonals_1 = Curve([<curve referenced from the Rhino model> x8])
brep = Brep([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])
brep_2 = Brep([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])
ramp = Brep(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)  # disabled

# ---- group: Stairs / Target box
crv = Curve([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])  # disabled
partition = PartitionList(List=crv, Size=2)  # disabled
disc = Discontinuity(Curve=partition, Level=1)  # -> simplify(Points), Parameters; disabled
trim = TrimTree(Tree=disc.Points, Depth=1)  # disabled
item = ListItem(List=trim, Index=0, Wrap=True)  # -> Item, Item1, Item2, Item3, Item4, Item5, Item6, Item7; disabled
tbox = TwistedBox(
    CornerA=item.Item,
    CornerB=item.Item1,
    CornerC=item.Item2,
    CornerD=item.Item3,
    CornerE=item.Item4,
    CornerF=item.Item5,
    CornerG=item.Item6,
    CornerH=item.Item7)  # disabled

# ----
# Excel Sheet
# Check the sections
crv_2 = Curve([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])

# ---- group: Stairs / Non distorted box
number_slider_2 = Slider(1, range=0..10)  # disabled
crv_3 = Curve([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])  # disabled
disc_2 = Discontinuity(Curve=crv_3, Level=1)  # -> simplify(Points), Parameters; disabled
shift = ShiftList(List=disc_2.Points, Shift=number_slider_2, Wrap=True)  # disabled
item_2 = ListItem(List=flatten(shift), Index=0, Wrap=True)  # -> Item, Item1, Item2, Item3, Item4, Item5, Item6, Item7; disabled
tbox_2 = TwistedBox(
    CornerA=item_2.Item,
    CornerB=item_2.Item1,
    CornerC=item_2.Item2,
    CornerD=item_2.Item3,
    CornerE=item_2.Item4,
    CornerF=item_2.Item5,
    CornerG=item_2.Item6,
    CornerH=item_2.Item7)  # disabled

# ----
scale = Scale(Geometry=ramp, Center=Point(0, 0, 0), Factor=number_slider)  # -> Geometry, Transform; disabled
c_script = CSharpScript(
    axes=curve,
    volume=mesh,
    stair_positions=stairs_cells,
    courtyard_positions=couryards_cells,
    diagonals_0=diagonals_0,
    diagonals_1=diagonals_1,
    column_thickness=Slider(0.45, range=0..1),
    beam_thickness=Slider(0.4, range=0..1),
    temp_short_beams_helper_0=brep,
    temp_short_beams_helper_1=brep_2,
    Reference="C:\USERS\PETRA\DESKTOP\Annen_V2\NGons\NGonsCore.dll")  # -> out, floor_meshes, stair_outlines, columns, grids, slab_beams, offset_beams, plates_lines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; inputs axes: tree of Polyline, volume: Mesh, stair_positions: list of Line, courtyard_positions: list of Line, diagonals_0: list of Line, diagonals_1: list of Line, column_thickness: Double, beam_thickness: Double, temp_short_beams_helper_0: list of Surface, temp_short_beams_helper_1: list of Surface
# ---------- c_script: C# usings ----------
using NGonsCore;
using System.Linq;
# ---------- c_script: C# ----------
    /////////////////////////////////////////////////////////////////////////////////////////////////////////////////////////////////////////////
    // Create grid
    /////////////////////////////////////////////////////////////////////////////////////////////////////////////////////////////////////////////

    GridPhanomena grid_phanomena = new GridPhanomena(
      _axes, // DataTree<Polyline>
      _volume, // Mesh
      _stair_positions, //List<Line>
      _courtyard_positions, // List<Line >
      _column_thickness, // double
      _beam_thickness, // double
      _diagonals_0, // List<Point3d>
      _diagonals_1//List<Point3d>
      );



    //get columns
    DataTree<Line> columns = get_columns(_axes, _volume);

    // mesh node system

    /////////////////////////////////////////////////////////////////////////////////////////////////////////////////////////////////////////////
    // Node
    // --- get current floor mesh
    // -*- get neighbors of a current vertex
    // --- get u and v direction of a mesh
    // --- get long edges, and construct short green beams
    // --- get short edges, and construct long green beams
    /////////////////////////////////////////////////////////////////////////////////////////////////////////////////////////////////////////////

    var lines_u = new List<Line>();
    for(int i = 0; i < 2; i++){
      // --- get current floor mesh
      Mesh floor = grid_phanomena.floor_meshes[i + 1].DuplicateMesh();
      Mesh floor_not_cleaned = grid_phanomena.floor_meshes_not_cleaned[i + 1].DuplicateMesh();
      floor_not_cleaned.Weld(0.01);

      // --- get u and v direction of a mesh
      bool[] u_or_v = new bool[0];
      warp_weft(floor, ref u_or_v);

      // --- get_beams_light_green

      int[] ids = Enumerable.Range(0, floor.TopologyVertices.Count).ToArray();
      double offset_distance = 0.45 * 0.5 + 0.3 * 0.5;
      foreach(var id in ids)
        get_beams_light_green(floor_not_cleaned, id, u_or_v, offset_distance, 0.8, ref lines_u);
    }





    B = lines_u;

    //
    //    public Polyline bot;
    //    public Polyline top;
    //    public Line[] vertical_lines;
    //D = grid_phanomena.meshes_boxes[1][0].vertical_lines;


    //gather outputs
    DataTree<Line> output_dark_green_beam = new DataTree<Line>();
    DataTree<Line> output_dark_green_beam_secondary = new DataTree<Line>();
    DataTree<Line> output_dark_green_beam_borders = new DataTree<Line>();
    DataTree<Polyline> output_slab = new DataTree<Polyline>();
    DataTree<Polyline> output_slab_beams = new DataTree<Polyline>();
    DataTree<Line> output_diagonals = new DataTree<Line>();
    DataTree<Line> output_vertical_lines = new DataTree<Line>();
    for (int i = 0; i < grid_phanomena.meshes_boxes.Count; i++)
    {
      for (int j = 0; j < grid_phanomena.meshes_boxes[i].Count; j++)
      {

        output_dark_green_beam.AddRange(grid_phanomena.meshes_boxes[i][j].dark_green_beam, new GH_Path(i));
        output_dark_green_beam_secondary.AddRange(grid_phanomena.meshes_boxes[i][j].dark_green_beam_secondary, new GH_Path(i));
        output_dark_green_beam_borders.AddRange(grid_phanomena.meshes_boxes[i][j].dark_green_beam_borders, new GH_Path(i));
        output_slab.AddRange(grid_phanomena.meshes_boxes[i][j].slab, new GH_Path(i, j));
        output_slab_beams.AddRange(grid_phanomena.meshes_boxes[i][j].slab_beams, new GH_Path(i, j));
        output_diagonals.AddRange(grid_phanomena.meshes_boxes[i][j].diagonals, new GH_Path(i));
        output_vertical_lines.AddRange(grid_phanomena.meshes_boxes[i][j].vertical_lines, new GH_Path(i, j));

      }
    }

    //output
    __columns = columns;

    __floor_meshes = grid_phanomena.floor_meshes;
    __stair_outlines = grid_phanomena.stair_outlines;
    __output_dark_green_beam = output_dark_green_beam;
    __output_dark_green_beam_secondary = output_dark_green_beam_secondary;
    __output_dark_green_beam_borders = output_dark_green_beam_borders;
    __output_slab = output_slab;
    __output_slab_beams = output_slab_beams;
    __output_diagonals = output_diagonals;
    __output_vertical_lines = output_vertical_lines;
# ---------- c_script: C# additional code ----------
  //globals
  double MAX_SPAN = 8.5;
  double LIGHT_GREEN_EXTENSION = 1.75;



  void get_beams_light_green(Mesh floor, int vertex, bool[] u_or_v, double offset_distance, double vertical_offset, ref List<Line> lines_u){


    // --- get neighbors of a current vertex
    List<int> vertex_neighbors = new List<int>();

    int[] vertex_edges = floor.TopologyVertices.ConnectedEdges(vertex);

    var vertex_neighbors_u = new List<int>();
    var vertex_neighbors_v = new List<int>();
    for(int i = 0; i < vertex_edges.Length; i++){
      Rhino.IndexPair pair = floor.TopologyEdges.GetTopologyVertices(vertex_edges[i]);
      int vertex_neighbor = pair.I == vertex ? pair.J : pair.I;
      if(u_or_v[vertex_edges[i]]){
        // lines_u.Add(floor.TopologyEdges.EdgeLine(vertex_edges[i]));
        vertex_neighbors_u.Add(vertex_neighbor);
      }
      else{
        //lines_v.Add(floor.TopologyEdges.EdgeLine(vertex_edges[i]));
        vertex_neighbors_v.Add(vertex_neighbor);
      }
    }

    // --- get long edges, and construct short green beams and move them side-ways
    Vector3d v = new Vector3d();
    List<double> distances = new List<double>();
    foreach(var n_v in vertex_neighbors_u){
      Vector3d dir = floor.TopologyVertices[n_v] - floor.TopologyVertices[vertex];
      double l = (dir.Length - MAX_SPAN + LIGHT_GREEN_EXTENSION ) / 2;
      //l = Math.Max(3.5, l);
      distances.Add(l);
      dir.Unitize();
      if(v.Length != 0)
        dir *= -1;
      v += dir;
    }
    v.Unitize();
    //double distance = 3.5;

    //v *= distance;

    //double d0 = Math.Max(3.499, (double) distances[0]);
    //double d1 = Math.Max(3.499, (double) distances[1 % distances.Count]);

    double d0 = (double) distances[0];
    double d1 = distances.Count == 2 ? (double) distances[1 % distances.Count] : 1;
    //Rhino.RhinoApp.WriteLine(d0.ToString() + " " + d1.ToString());
    // d0 = 3.49;
    //d1 = 3.49;

    Line short_light_green_beam = new Line(
      (Point3d) floor.TopologyVertices[vertex] + v * d0,
      (Point3d) floor.TopologyVertices[vertex] - v * d1);


    //    Line short_light_green_beam = new Line(
    //      (Point3d) floor.TopologyVertices[vertex] + v * (double)  distances[0],
    //      (Point3d) floor.TopologyVertices[vertex] - v * (double) distances[1 % distances.Count]);

    //    if(distances[0] > 3.5 || distances[1 % distances.Count] > 3.5){
    //      Rhino.RhinoDoc.ActiveDoc.Objects.AddLine(short_light_green_beam);
    //    }
    //
    //    Line short_light_green_beam = new Line(
    //      (Point3d) floor.TopologyVertices[vertex] + v * 3.5,
    //      (Point3d) floor.TopologyVertices[vertex] - v *3.5);

    //vertical offset
    Line line = new Line(Point3d.Origin, Point3d.Origin + floor.Normals[vertex]);
    double t;
    Rhino.Geometry.Intersect.Intersection.LinePlane(line, new Plane(new Point3d(0, 0, vertical_offset), Vector3d.ZAxis), out t);
    Vector3d vertical_offset_dir = -(Vector3d) line.PointAt(t);
    short_light_green_beam.Transform(Transform.Translation(vertical_offset_dir));

    //copy the line and move sideways two times
    Line short_light_green_beam_0 = short_light_green_beam;
    Line short_light_green_beam_1 = short_light_green_beam;
    Vector3d move_dir = (Point3d) floor.TopologyVertices[vertex] - (Point3d) floor.TopologyVertices[vertex_neighbors_v[0]];
    move_dir.Unitize();
    move_dir *= offset_distance;
    short_light_green_beam_0.Transform(Transform.Translation(move_dir));
    short_light_green_beam_1.Transform(Transform.Translation(-move_dir));
    lines_u.Add(short_light_green_beam_0);
    lines_u.Add(short_light_green_beam_1);

    // --- get short edges, and construct long green beams

  }

  void warp_weft(Mesh mesh, ref  bool[] u_or_v)
  {


    mesh.Vertices.CombineIdentical(true, true);
    mesh.TopologyVertices.SortEdges();

    int[] numArray = new int[mesh.TopologyEdges.Count];
    bool[] flagArray = new bool[mesh.TopologyEdges.Count];
    bool[] flagArray1 = new bool[mesh.TopologyEdges.Count];
    int num = 0;
    int num1 = 0;
    int num2 = 0;

    while (true)
    {
      if (num2 >= mesh.TopologyEdges.Count)
      {
        break;
      }
      else if ((int) mesh.TopologyEdges.GetConnectedFaces(num2).Length != 2)
      {
        num2++;
      }
      else
      {
        numArray[num2] = 1;
        flagArray[num2] = true;
        num = 1;
        break;
      }
    }

    while (num < mesh.TopologyEdges.Count && num1 < mesh.TopologyEdges.Count)
    {
      int num3 = 0;
      int num4 = 0;
      while (num4 < mesh.TopologyEdges.Count)
      {
        if (!flagArray[num4] || flagArray1[num4] || (int) mesh.TopologyEdges.GetConnectedFaces(num4).Length != 2)
        {
          num4++;
        }
        else
        {
          num3 = num4;
          break;
        }
      }

      IndexPair topologyVertices = mesh.TopologyEdges.GetTopologyVertices(num3);
      int i = topologyVertices.I;
      topologyVertices = mesh.TopologyEdges.GetTopologyVertices(num3);
      int j = topologyVertices.J;

      int length = (int) mesh.TopologyVertices.ConnectedTopologyVertices(i).Length;
      for (int i1 = 0; i1 < length; i1++)
      {
        int num5 = mesh.TopologyVertices.ConnectedTopologyVertices(i)[i1];
        if (num3 == mesh.TopologyEdges.GetEdgeIndex(i, num5))
        {
          int num6 = (i1 + 1) % length;
          int num7 = mesh.TopologyVertices.ConnectedTopologyVertices(i)[num6];
          int edgeIndex = mesh.TopologyEdges.GetEdgeIndex(i, num7);
          if (!flagArray[edgeIndex])
          {
            if (numArray[num3] != 0)
            {
              numArray[edgeIndex] = 0;
            }
            else
            {
              numArray[edgeIndex] = 1;
            }
            flagArray[edgeIndex] = true;
            num++;
          }
          int num8 = (i1 - 1 + length) % length;
          int num9 = mesh.TopologyVertices.ConnectedTopologyVertices(i)[num8];
          int edgeIndex1 = mesh.TopologyEdges.GetEdgeIndex(i, num9);
          if (!flagArray[edgeIndex1])
          {
            if (numArray[num3] != 0)
            {
              numArray[edgeIndex1] = 0;
            }
            else
            {
              numArray[edgeIndex1] = 1;
            }
            flagArray[edgeIndex1] = true;
            num++;
          }
        }
      }
      length = (int) mesh.TopologyVertices.ConnectedTopologyVertices(j).Length;
      for (int j1 = 0; j1 < length; j1++)
      {
        int num10 = mesh.TopologyVertices.ConnectedTopologyVertices(j)[j1];
        if (num3 == mesh.TopologyEdges.GetEdgeIndex(j, num10))
        {
          int num11 = (j1 + 1) % length;
          int num12 = mesh.TopologyVertices.ConnectedTopologyVertices(j)[num11];
          int edgeIndex2 = mesh.TopologyEdges.GetEdgeIndex(j, num12);
          if (!flagArray[edgeIndex2])
          {
            if (numArray[num3] != 0)
            {
              numArray[edgeIndex2] = 0;
            }
            else
            {
              numArray[edgeIndex2] = 1;
            }
            flagArray[edgeIndex2] = true;
            num++;
          }
          int num13 = (j1 - 1 + length) % length;
          int num14 = mesh.TopologyVertices.ConnectedTopologyVertices(j)[num13];
          int edgeIndex3 = mesh.TopologyEdges.GetEdgeIndex(j, num14);
          if (!flagArray[edgeIndex3])
          {
            if (numArray[num3] != 0)
            {
              numArray[edgeIndex3] = 0;
            }
            else
            {
              numArray[edgeIndex3] = 1;
            }
            flagArray[edgeIndex3] = true;
            num++;
          }
        }
      }
      flagArray1[num3] = true;
      num1++;
    }
    List<Line> lines = new List<Line>();
    List<Line> lines1 = new List<Line>();
    List<int> lines0_id = new List<int>();
    List<int> lines1_id = new List<int>();
    List<bool> flags = new List<bool>();
    List<bool> flags1 = new List<bool>();
    u_or_v = new bool[mesh.TopologyEdges.Count];
    for (int k = 0; k < mesh.TopologyEdges.Count; k++)
    {
      if (numArray[k] != 0)
      {
        lines1.Add(mesh.TopologyEdges.EdgeLine(k));
        lines0_id.Add(k);
        u_or_v[k] = true;
        if ((int) mesh.TopologyEdges.GetConnectedFaces(k).Length != 2)
        {
          flags1.Add(true);
        }
        else
        {
          flags1.Add(false);
        }
      }
      else
      {
        lines.Add(mesh.TopologyEdges.EdgeLine(k));
        u_or_v[k] = false;
        lines1_id.Add(k);
        if ((int) mesh.TopologyEdges.GetConnectedFaces(k).Length != 2)
        {
          flags.Add(true);
        }
        else
        {
          flags.Add(false);
        }
      }
    }
    //    DA.SetDataList(0, lines);
    //    DA.SetDataList(1, lines1);
    //    DA.SetDataList(2, flags);
    //    DA.SetDataList(3, flags1);
  }

  class GridBox{

    // input

    public int id;
    public int[] edge_ids;
    public bool even_stripe = false;
    public bool even_even_stripe = false;
    public bool odd_strip_face_that_has_vertex_connected_to_oneface = false;
    public Polyline bot;
    public Polyline top;
    public Line[] vertical_lines;

    // output
    public List<Line> dark_green_beam = new List<Line>();
    public List<Line> dark_green_beam_secondary = new List<Line>();
    public List<Line> dark_green_beam_borders = new List<Line>();
    public List<Polyline> slab = new List<Polyline>();
    public List<Polyline> slab_beams = new List<Polyline>();
    public List<Line> diagonals = new List<Line>();


    Polyline get_section(double z){

      Plane plane = new Plane(new Point3d(0, 0, bot[0].Z + z), Vector3d.ZAxis);
      Polyline section = new Polyline();
      foreach(Line vertical_line in vertical_lines){
        double t;
        Rhino.Geometry.Intersect.Intersection.LinePlane(vertical_line, plane, out t);
        section.Add(vertical_line.PointAt(t));
      }
      section.Add(section[0]);
      return section;

    }

    public Line intersect_line_and_two_lines(ref Line side0, ref Line side1, ref Line edge_line, double offset = 0.4, double scale = 1, double rotation = 0.0, int middle_or_perp_or_interpolation = 0){

      //copy
      Line copy_line_ = edge_line;


      // move by middle line, not the perpednicular line
      //      Point3d mid0 = (side0.From + side1.From) * 0.5;
      //      Point3d mid1 = (side0.To + side1.To) * 0.5;
      //      Vector3d translation_vector = mid0 - mid1;
      //      translation_vector.Unitize();
      //      translation_vector *= offset;
      //      copy_line_.Transform(Transform.Translation(translation_vector));




      if(middle_or_perp_or_interpolation == 0){
        Point3d mid0 = (side0.From + side1.From) * 0.5;
        Point3d mid1 = (side0.To + side1.To) * 0.5;
        Vector3d translation_vector = mid0 - mid1;
        translation_vector.Unitize();
        translation_vector *= offset;
        copy_line_.Transform(Transform.Translation(translation_vector));
      }else if (middle_or_perp_or_interpolation == 2){

        Vector3d translation_vector_0 = side0.From - side0.To;
        Vector3d translation_vector_1 = side1.From - side1.To;


      }else{
        //        Vector3d translation_vector = Vector3d.CrossProduct(Vector3d.ZAxis, copy_line_.Direction);
        //        translation_vector.Unitize();
        //        translation_vector *= offset;
        //        copy_line_.Transform(Transform.Translation(translation_vector));
      }

      //intersect
      double t0, t1;

      Rhino.Geometry.Intersect.Intersection.LineLine(side0, copy_line_, out t0, out t1, 0.01, false);
      Point3d p0 = side0.PointAt(t0);
      Point3d p1_ = side1.PointAt(t0);
      Rhino.Geometry.Intersect.Intersection.LineLine(side1, copy_line_, out t0, out t1, 0.01, false);
      Point3d p1 = side1.PointAt(t0);
      Line intersection_line = new Line(p0, p1);
      Line intersection_line_ = new Line(p0, p1_);
      intersection_line = intersection_line_;
      //Rhino.RhinoDoc.ActiveDoc.Objects.AddLine(intersection_line);

      //secondary transformatins: scale and rotate
      intersection_line.Transform(Transform.Scale(intersection_line.Center(), scale));
      intersection_line.Transform(Transform.Rotation(rotation, (p0 + p1) * 0.5));


      return intersection_line;

    }

    public void get_beams_dark_green(ref Mesh floor, double z = 4.5, double offset = 0.4, double scale = 2.1){


      Polyline section = get_section(z);


      Line side0 = new Line(section[1], section[2]);
      Line side1 = new Line(section[0], section[3]);
      double local_offset_0 = 0.4;
      double local_offset_1 = 0.4;
      double l = (Math.Max(side0.Length, side1.Length) - 8.5) * 0.5;
      // l = (side1.Length - 8.5)*0.5;

      l = ((side1.Length + side0.Length) * 0.5 - 8.5) * 0.5;
      if(!even_even_stripe){
        //l += local_offset;
      }
      int sign = even_stripe ? -1 : 1;

      //front
      int[] faces_vertices = floor.TopologyVertices.IndicesFromFace(id);
      int front_edge = floor.TopologyEdges.GetEdgeIndex(faces_vertices[0], faces_vertices[1]);
      int back_edge = floor.TopologyEdges.GetEdgeIndex(faces_vertices[2], faces_vertices[3]);



      //create a line by intersection of the grid
      Line front_edge_line = new Line(section[0], section[1]);
      Line back_edge_line = new Line(section[2], section[3]);



      /////////////////////////////////////////////////////////////////////////////////////////////////////////////////////////////////////////////
      // main beams - around the columns
      /////////////////////////////////////////////////////////////////////////////////////////////////////////////////////////////////////////////
      dark_green_beam.Add(intersect_line_and_two_lines(ref side0, ref side1, ref front_edge_line, offset * sign, 1.35, 0, 0));


      /////////////////////////////////////////////////////////////////////////////////////////////////////////////////////////////////////////////
      // main beams - borders
      /////////////////////////////////////////////////////////////////////////////////////////////////////////////////////////////////////////////
      if(floor.TopologyEdges.GetConnectedFaces(back_edge).Length == 1 ) {
        dark_green_beam.Add(intersect_line_and_two_lines(ref side0, ref side1, ref back_edge_line, offset * sign, 1.3));
      }

      /////////////////////////////////////////////////////////////////////////////////////////////////////////////////////////////////////////////
      // secondary beam - left and right side s
      /////////////////////////////////////////////////////////////////////////////////////////////////////////////////////////////////////////////
      if(even_stripe || true){
        dark_green_beam_secondary.Add(intersect_line_and_two_lines(ref side0, ref side1, ref front_edge_line, -l + sign * local_offset_1 * -1, scale * 0 + 1.35, 0.00, 0));
        dark_green_beam_secondary.Add(intersect_line_and_two_lines(ref side0, ref side1, ref back_edge_line, l + sign * local_offset_1 * -1, scale * 0 + 1.35, 0.00, 0));
      }





    }

    void get_edge(){

    }

    public void get_panel(double z = 0.042 ){
      slab.Add(get_section(5));
      slab.Add(get_section(5 - z));
    }

    public Line intersect_line_and_two_lines_girders(ref Line side0, ref Line side1, ref Line edge_line, double offset = 0.4, double scale = 1, double rotation = 0.0, int middle_or_perp_or_interpolation = 0){

      //copy
      Line copy_line_ = edge_line;



      Point3d mid0 = (side0.From + side1.From) * 0.5;
      Point3d mid1 = (side0.To + side1.To) * 0.5;
      Vector3d translation_vector = mid0 - mid1;
      translation_vector.Unitize();
      translation_vector *= offset;
      copy_line_.Transform(Transform.Translation(translation_vector));





      //intersect
      double t0, t1;

      Rhino.Geometry.Intersect.Intersection.LineLine(side0, copy_line_, out t0, out t1, 0.01, false);
      Point3d p0 = side0.PointAt(t0);
      Rhino.Geometry.Intersect.Intersection.LineLine(side1, copy_line_, out t0, out t1, 0.01, false);
      Point3d p1 = side1.PointAt(t0);
      Line intersection_line = new Line(p0, p1);
      //Rhino.RhinoDoc.ActiveDoc.Objects.AddLine(intersection_line);

      //secondary transformatins: scale and rotate
      intersection_line.Transform(Transform.Scale(intersection_line.Center(), scale));
      intersection_line.Transform(Transform.Rotation(rotation, (p0 + p1) * 0.5));


      return intersection_line;

    }

    public  void get_slab_beams(double z = 0.042, double height = 0.28, double width = 0.12, double step = 0.52){
      Polyline section0 = get_section(5 - z);
      Polyline section1 = get_section(5 - z - height);
      Line side0 = section0.SegmentAt(0);
      Line side1 = section0.SegmentAt(2);
      Line side0_ = section1.SegmentAt(0);
      Line side1_ = section1.SegmentAt(2);

      Line mid_line = new Line(side0.PointAt(0.5), side1.PointAt(0.5));
      double[] distances_to_the_mid_line = new double[]{
        mid_line.ClosestPoint(side0.From, false).DistanceTo(side0.From),
        mid_line.ClosestPoint(side0.To, false).DistanceTo(side0.To),
        mid_line.ClosestPoint(side1.From, false).DistanceTo(side1.From),
        mid_line.ClosestPoint(side1.To, false).DistanceTo(side1.To)
        };
      Array.Sort(distances_to_the_mid_line);
      double smallest_dist = distances_to_the_mid_line[0];
      int count = (int) Math.Round(smallest_dist / step, 0) * 2;
      smallest_dist = count * step * 0.5 - step;

      Vector3d offset_dir = Vector3d.CrossProduct(Vector3d.ZAxis, mid_line.Direction);
      offset_dir.Unitize();
      offset_dir *= smallest_dist;
      mid_line.Transform(Transform.Translation(offset_dir + offset_dir.Unit() * step * 0.5));
      offset_dir.Unitize();

      Vector3d[] volumetric_line_translation = new Vector3d[]{
        offset_dir * width * 0.5,
        -offset_dir * width * 0.5,
        -offset_dir * width * 0.5 - Vector3d.ZAxis * height,
        offset_dir * width * 0.5 - Vector3d.ZAxis * height,
        };

      for(int i = 0; i < count ;i++){

        // slab_beams.Add(mid_line.ToPolyline());



        Line mid_line_0 = mid_line;
        mid_line_0.Transform(Transform.Translation(-offset_dir * step * i + volumetric_line_translation[0]));
        mid_line_0 = intersect_line_and_two_lines_girders(ref side0, ref side1, ref mid_line_0, 0, 1);

        //
        //        if(id == 0){
        //          Rhino.RhinoDoc.ActiveDoc.Objects.AddLine(mid_line);
        //          Rhino.RhinoDoc.ActiveDoc.Objects.AddLine(side0);
        //          Rhino.RhinoDoc.ActiveDoc.Objects.AddLine(side1);
        //        }
        //   slab_beams.Add(mid_line_0.ToPolyline());




        Line mid_line_1 = mid_line;
        mid_line_1.Transform(Transform.Translation(-offset_dir * step * i + volumetric_line_translation[1]));
        mid_line_1 = intersect_line_and_two_lines_girders(ref side0, ref side1, ref mid_line_1, 0, 1);



        Line mid_line_2 = mid_line;
        mid_line_2.Transform(Transform.Translation(-offset_dir * step * i + volumetric_line_translation[2]));
        mid_line_2 = intersect_line_and_two_lines_girders(ref side0_, ref side1_, ref mid_line_2, 0, 1);


        Line mid_line_3 = mid_line;
        mid_line_3.Transform(Transform.Translation(-offset_dir * step * i + volumetric_line_translation[3]));
        mid_line_3 = intersect_line_and_two_lines_girders(ref side0_, ref side1_, ref mid_line_3, 0, 1);


        Polyline rect0 = new Polyline(new Point3d[]{mid_line_0.From,mid_line_1.From,mid_line_2.From,mid_line_3.From,mid_line_0.From});
        Polyline rect1 = new Polyline(new Point3d[]{mid_line_0.To,mid_line_1.To,mid_line_2.To,mid_line_3.To,mid_line_0.To});
        //Rhino.RhinoDoc.ActiveDoc.Objects.AddPolyline(rect0) ;
        slab_beams.Add(rect0);
        slab_beams.Add(rect1);

      }




    }

    public void get_diagonals(ref List<Line> diagonals_0,ref List<Line> diagonals_1, ref List<List<bool>> mesh_edge_flags, int id, double dist = 0.1, double offset = 0.3){
      //
      //      if(this.id < 5){
      //        Rhino.RhinoApp.WriteLine();
      //  }
      //      if(id == 0){
      //        Rhino.RhinoApp.WriteLine(" ");
      //        foreach(int edge_id in this.edge_ids)
      //          Rhino.RhinoApp.Write(edge_id.ToString() + " ");
      //        Rhino.RhinoApp.Write(" | ");
      //
      //
      //      }

      //Rhino.RhinoApp.WriteLine(mesh_edge_flags.Count.ToString());
      //Rhino.RhinoApp.WriteLine(mesh_edge_flags[0].Count.ToString());
      // Rhino.RhinoApp.WriteLine(mesh_edge_flags[id].Count.ToString());

      //
      //      Rhino.RhinoDoc.ActiveDoc.Objects.AddPolyline(this.top);
      //Rhino.RhinoDoc.ActiveDoc.Objects.AddPolyline(new Polyline(new Point3d[]{vertical_lines[2].PointAt(0.5),vertical_lines[3].PointAt(0.5)}));
      //      Rhino.RhinoApp.WriteLine(
      //        edge_ids[0].ToString() + " " + mesh_edge_flags[id][edge_ids[0]].ToString() + " " +
      //        edge_ids[1].ToString() + " " + mesh_edge_flags[id][edge_ids[1]].ToString() + " " +
      //        edge_ids[2].ToString() + " " + mesh_edge_flags[id][edge_ids[2]].ToString() + " " +
      //        edge_ids[3].ToString() + " " + mesh_edge_flags[id][edge_ids[3]].ToString() + " "
      //
      //
      //        );

      for(int i = 0; i < 4; i++){
        Line l0 = vertical_lines[(i + 0) % 4];
        Line l1 = vertical_lines[(i + 1) % 4];
        int next_id = NGonsCore.MathUtil.Wrap(i + 1, 4);
        //        if(this.id < 5){
        //
        //          Rhino.RhinoDoc.ActiveDoc.Objects.AddTextDot(edge_ids[next_id].ToString(), (l0.From + l1.From) * 0.5);
        //        }





        for(int j = 0; j < diagonals_0.Count; j++){

          Line nearest_diagonal = diagonals_0[j];
          if(nearest_diagonal.FromZ < nearest_diagonal.ToZ)
            nearest_diagonal.Flip();

          double dist00 = l0.ClosestPoint(nearest_diagonal.From, true).DistanceTo(nearest_diagonal.From);
          double dist01 = l0.ClosestPoint(nearest_diagonal.To, true).DistanceTo(nearest_diagonal.To);

          double dist10 = l1.ClosestPoint(nearest_diagonal.From, true).DistanceTo(nearest_diagonal.From);
          double dist11 = l1.ClosestPoint(nearest_diagonal.To, true).DistanceTo(nearest_diagonal.To);

          bool flag00 = dist00 < dist;
          bool flag01 = dist01 < dist;
          bool flag10 = dist10 < dist;
          bool flag11 = dist11 < dist;


          if( (flag00 || flag01) && (flag10 || flag11) && (!mesh_edge_flags[id][edge_ids[next_id]]) ){

            //Rhino.RhinoDoc.ActiveDoc.Objects.AddLine(diagonals_0[j]);

            Line diagonal = Line.Unset;

            if(flag00)
              diagonal = new Line(diagonal.From, l0.PointAt(0.7));
            if(flag01)
              diagonal = new Line(l0.PointAt(0.15), diagonal.To);
            if(flag10)
              diagonal = new Line(diagonal.From, l1.PointAt(0.7));
            if(flag11)
              diagonal = new Line(l1.PointAt(0.15), diagonal.To);

            mesh_edge_flags[id][edge_ids[next_id]] = true;
            //         if(this.id<5)
            //                      Rhino.RhinoApp.Write(edge_ids[next_id].ToString() + " " );
            //
            //             Rhino.RhinoDoc.ActiveDoc.Objects.AddLine( this.top.SegmentAt(i) );




            //Rhino.RhinoApp.Write(" " + edge_ids[i].ToString());

            //

            // extend, move and add
            diagonal.Extend(0.6, 0.6);
            Vector3d x_axis = (l0.Direction + l1.Direction) * 0.5;
            Vector3d y_axis = l1.To - l0.To;
            Vector3d z_axis = Vector3d.CrossProduct(x_axis, y_axis);
            z_axis.Unitize();

            if(i == 0 || i == 2)
              z_axis *= offset;
            else
              z_axis *= offset * 2;
            diagonal.Transform(Transform.Translation(-z_axis));

            diagonals.Add(diagonal);

          }


        }

        for(int j = 0; j < diagonals_1.Count; j++){


          Line nearest_diagonal = diagonals_1[j];
          if(nearest_diagonal.FromZ < nearest_diagonal.ToZ)
            nearest_diagonal.Flip();

          double dist00 = l0.ClosestPoint(nearest_diagonal.From, true).DistanceTo(nearest_diagonal.From);
          double dist01 = l0.ClosestPoint(nearest_diagonal.To, true).DistanceTo(nearest_diagonal.To);

          double dist10 = l1.ClosestPoint(nearest_diagonal.From, true).DistanceTo(nearest_diagonal.From);
          double dist11 = l1.ClosestPoint(nearest_diagonal.To, true).DistanceTo(nearest_diagonal.To);

          bool flag00 = dist00 < dist;
          bool flag01 = dist01 < dist;
          bool flag10 = dist10 < dist;
          bool flag11 = dist11 < dist;


          if( (flag00 || flag01) && (flag10 || flag11) && (!mesh_edge_flags[id][edge_ids[next_id]]) ){

            //Rhino.RhinoDoc.ActiveDoc.Objects.AddLine(diagonals_0[j]);

            Line diagonal = Line.Unset;

            if(flag00)
              diagonal = new Line(diagonal.From, l0.PointAt(0.55));
            if(flag01)
              diagonal = new Line(l0.PointAt(0.25), diagonal.To);
            if(flag10)
              diagonal = new Line(diagonal.From, l1.PointAt(0.55));
            if(flag11)
              diagonal = new Line(l1.PointAt(0.25), diagonal.To);

            mesh_edge_flags[id][edge_ids[next_id]] = true;

            // extend, move and add
            diagonal.Extend(0.6, 0.6);
            Vector3d x_axis = (l0.Direction + l1.Direction) * 0.5;
            Vector3d y_axis = l1.To - l0.To;
            Vector3d z_axis = Vector3d.CrossProduct(x_axis, y_axis);
            z_axis.Unitize();

            if(i == 0 || i == 2)
              z_axis *= offset;
            else
              z_axis *= offset * 2;
            diagonal.Transform(Transform.Translation(-z_axis));

            diagonals.Add(diagonal);

          }


        }
      }//for i



      //        Point3d center = (l0.PointAt(0.5) + l1.PointAt(0.5)) * 0.5;
      //
      //        foreach(Point3d p in center_of_diagonals_u){
      //          if(p.DistanceTo(center) < dist){
      //            diagonals.Add(new Line(l1.PointAt(0.1), l0.PointAt(0.65)));
      //          }
      //        }
      //
      //        //        foreach(Point3d p in center_of_diagonals_v){
      //        //          if(p.DistanceTo(center) < dist){
      //        //            diagonals.Add(new Line(l0.PointAt(0.1), l1.PointAt(0.65)));
      //        //          }
      //        //        }
      //
      //
      //      }

    }


  }

  class GridPhanomena {

    /////////////////////////////////////////////////////////////////////////////////////////////////////////////////////////////////////////////
    // properties
    /////////////////////////////////////////////////////////////////////////////////////////////////////////////////////////////////////////////

    //input
    List<List<Polyline>> axes = new List<List<Polyline>>(); // polyline axes of the full grid
    int u,v = 0; // one axis length
    Mesh volume = new Mesh(); // volume that is used to remove the grid rectangles

    List<Line> stairs_positions = new List<Line>();
    List<Line> courtyard_positions = new List<Line>();
    double column_thickness, beam_thickness;
    public List<Line> diagonals_0 = new List<Line>();
    public List<Line> diagonals_1 = new List<Line>();

    //inner data-structures
    public List<List<bool>> meshes_stripes = new List<List<bool>>();
    public List<Mesh> floor_meshes = new List<Mesh>(); // multiple floors
    public List<Mesh> floor_meshes_not_cleaned = new List<Mesh>(); // multiple floors not cleaned
    public List<List<bool>> meshes_edge_flags = new List<List<bool>>();
    public List<List<Point3d>> floor_meshes_face_centers = new List<List<Point3d>>();//two floor edges
    public List<List<GridBox>> meshes_boxes = new List<List<GridBox>>();


    List<List<List<int>>> columns_of_grid = new List<List<List<int>>>(); // indices of grid that represents the columns

    //output
    public List<Polyline> stair_outlines = new List<Polyline>(); //grid of boxes
    public List<Polyline> columns = new List<Polyline>();
    public List<Polyline> beams_short = new List<Polyline>();
    public List<Polyline> beams_long = new List<Polyline>();
    public List<Polyline> slab = new List<Polyline>();

    /////////////////////////////////////////////////////////////////////////////////////////////////////////////////////////////////////////////
    // constructor
    /////////////////////////////////////////////////////////////////////////////////////////////////////////////////////////////////////////////

    public GridPhanomena(
      DataTree<Polyline> _axes,
      Mesh _volume,
      List<Line> _stairs_positions,
      List<Line> _courtyard_positions,
      double _column_thickness,
      double _beam_thickness,
      List<Line> _diagonals_0,
      List<Line> _diagonals_1
    ){


      //set properties

      for(int i = 0; i < _axes.BranchCount; i++){
        this.axes.Add(_axes.Branch(i));
      }

      this.u = this.axes[0][0].Count;
      this.v = this.axes[0].Count;

      this.volume = _volume;
      this.stairs_positions = _stairs_positions;
      this.courtyard_positions = _courtyard_positions;
      this.diagonals_0 = _diagonals_0;
      this.diagonals_1 = _diagonals_1;
      this.column_thickness = _column_thickness;
      this.beam_thickness = _beam_thickness;
      this.diagonals_0 = _diagonals_0;
      this.diagonals_1 = _diagonals_1;

      //init methods
      get_mesh();
      get_stairs();




      for(int i = 0; i < meshes_boxes.Count; i++){

        Mesh floor_mesh = floor_meshes[i + 1];
        //floor_mesh = floor_mesh.WeldUsingRTree(0.01, false, false);
        floor_mesh.Weld(0.01);
        floor_mesh.RebuildNormals();
        //Rhino.RhinoApp.WriteLine("Number of overtices" + floor_mesh.Vertices.Count.ToString());
        //Rhino.RhinoDoc.ActiveDoc.Objects.AddMesh(floor_mesh);
        // floor_mesh.Clean();

        //assign edge indices since the topology is changed


        //assign mesh
        //this.floor_meshes_not_cleaned[i].Clean();
        int edges_count = floor_mesh.TopologyEdges.Count;
        // Rhino.RhinoApp.WriteLine("Edges Count " + edges_count.ToString());
        List<bool> edge_flags = (new bool[edges_count]).ToList();
        this.meshes_edge_flags.Add(edge_flags);
        //Rhino.RhinoApp.WriteLine("_"+meshes_edge_flags.Count.ToString());
        //         Rhino.RhinoApp.WriteLine("_" + floor_mesh.TopologyEdges.Count.ToString());
        //        Rhino.RhinoApp.WriteLine("_" +meshes_edge_flags.Last().Count.ToString());


        for(int j = 0; j < meshes_boxes[i].Count; j++){
          meshes_boxes[i][j].edge_ids = floor_mesh.TopologyEdges.GetEdgesForFace(meshes_boxes[i][j].id);
          //          Rhino.RhinoApp.WriteLine(
          //            meshes_boxes[i][j].edge_ids[0].ToString() + " " +
          //            meshes_boxes[i][j].edge_ids[1].ToString() + " " +
          //            meshes_boxes[i][j].edge_ids[2].ToString() + " " +
          //            meshes_boxes[i][j].edge_ids[3].ToString()
          //
          //            );
          meshes_boxes[i][j].get_beams_dark_green(ref floor_mesh);
          meshes_boxes[i][j].get_panel();
          meshes_boxes[i][j].get_slab_beams();
          meshes_boxes[i][j].get_diagonals(ref _diagonals_0, ref _diagonals_1, ref meshes_edge_flags, i);

        }

      }
    }

    /////////////////////////////////////////////////////////////////////////////////////////////////////////////////////////////////////////////
    // methods
    /////////////////////////////////////////////////////////////////////////////////////////////////////////////////////////////////////////////

    public void get_mesh(){

      //iterate floors
      for(int i = 0; i < axes.Count; i++){

        Mesh floor_mesh = new Mesh();
        List<bool> mesh_stripes = new List<bool>();
        if(i != 0){
          this.meshes_boxes.Add(new List<GridBox>());
        }

        // add axes vertices to the mesh
        for(int j = 0; j < axes[i].Count; j++){
          floor_mesh.Vertices.AddVertices(axes[i][j]);

          //normals are the column directions
          for(int k = 0; k < axes[i][j].Count; k++){
            Vector3d vertex_normal = axes[1][j][k] - axes[0][j][k];
            floor_mesh.Normals.Add(vertex_normal);
          }//i

        }// j

        // add faces to the mesh
        floor_meshes_face_centers.Add(new List<Point3d>(u * v));
        for(int j = 0; j < axes[i].Count - 1; j++){

          for(int k = 0; k < axes[i][j].Count - 1; k++){//

            // skip points that are not inside the mesh
            Point3d center = ((Point3d) floor_mesh.Vertices[(j) *u + (k)] + (Point3d) floor_mesh.Vertices[(j + 1) * u + (k + 1)]) * 0.5;
            floor_meshes_face_centers[i].Add(center);
            if(i != 0)
              if(!volume.IsPointInside(center, 0.01, true))
                continue;

            // add mesh faces
            floor_mesh.Faces.AddFace(
              (j) *u + (k),
              (j) *u + (k + 1),
              (j + 1) * u + (k + 1),
              (j + 1) * u + (k)
              );

            // add boolean flag for the longituadinal axes
            mesh_stripes.Add(k % 2 == 0);

            if(i == 0)
              continue;

            bool odd_strip_face_that_has_vertex_connected_to_oneface_ = k % 2 == 1;





            //create boxes
            //public List<GridBox> meshes_boxes = new List<GridBox>();
            this.meshes_boxes[i - 1].Add(new GridBox(){

                //id = floor_mesh.Faces.Count - 1,
                id = floor_mesh.Faces.Count - 1,
                even_stripe = k % 2 == 0,
                even_even_stripe = k / 2 % 2 == 0,




                top = new Polyline(new Point3d[]{
                floor_mesh.Vertices[(j) *u + (k)],
                floor_mesh.Vertices[(j) *u + (k + 1)],
                floor_mesh.Vertices[(j + 1) * u + (k + 1)],
                floor_mesh.Vertices[(j + 1) * u + (k)],
                floor_mesh.Vertices[(j) *u + (k)],
                }),

                bot = new Polyline(new Point3d[]{
                floor_meshes[i - 1].Vertices[(j) *u + (k)],
                floor_meshes[i - 1].Vertices[(j) *u + (k + 1)],
                floor_meshes[i - 1].Vertices[(j + 1) * u + (k + 1)],
                floor_meshes[i - 1].Vertices[(j + 1) * u + (k)],
                floor_meshes[i - 1].Vertices[(j) *u + (k)],
                }),

                vertical_lines = new Line[]{
                new Line(floor_meshes[i - 1].Vertices[(j) *u + (k)], floor_mesh.Vertices[(j) *u + (k)]),
                new Line(floor_meshes[i - 1].Vertices[(j) *u + (k + 1)], floor_mesh.Vertices[(j) *u + (k + 1)]),
                new Line(floor_meshes[i - 1].Vertices[(j + 1) * u + (k + 1)], floor_mesh.Vertices[(j + 1) * u + (k + 1)]),
                new Line(floor_meshes[i - 1].Vertices[(j + 1) * u + (k)], floor_mesh.Vertices[(j + 1) * u + (k)]),

                }

                });


          }//k
        }// j

        floor_meshes.Add(floor_mesh);
        floor_meshes_not_cleaned.Add(floor_mesh.DuplicateMesh());

        if(i == 0)
          continue;

        //Rhino.RhinoApp.WriteLine(this.meshes_boxes.Count.ToString());

        //var a = this.meshes_boxes[this.meshes_boxes.Count-1];

        for(int j = 0; j < floor_mesh.Faces.Count; j++){

          int[] face_vertices = new int[]{
            floor_mesh.Faces[j].A,
            floor_mesh.Faces[j].B,
            floor_mesh.Faces[j].C,
            floor_mesh.Faces[j].D
            };

          for(int k = 0; k < 4; k++){
            int[] vertex_faces = floor_mesh.TopologyVertices.ConnectedFaces(face_vertices[k]);
            if(vertex_faces.Length == 1){



              if( !this.meshes_boxes[this.meshes_boxes.Count - 1][j].even_stripe ) {
                this.meshes_boxes[this.meshes_boxes.Count - 1][j].odd_strip_face_that_has_vertex_connected_to_oneface = true;
              }

              break;
            }

          }

        }



        meshes_stripes.Add(mesh_stripes);
      }// i



    }

    public void get_stairs(){

      stair_outlines = new List<Polyline>(stairs_positions.Count * 2);

      for(int i = 0; i < floor_meshes.Count; i++){

        //iterate mesh faces and check stair line exists

        for(int j = 0; j < floor_meshes[i].Faces.Count ; j++){



          foreach (Line stair_line in stairs_positions){

            //Rhino.RhinoApp.WriteLine((stair_line.ClosestPoint(floor_meshes_face_centers[i][j], false).DistanceTo(floor_meshes_face_centers[i][j]) ).ToString());
            if(stair_line.PointAt(0.5).DistanceTo(floor_meshes_face_centers[i][j]) < 0.2){

              // Rhino.RhinoDoc.ActiveDoc.Objects.AddPoint(floor_meshes_face_centers[i][j]);

              Polyline bottom_rect = new Polyline(new Point3d[]{
                floor_meshes[i].Vertices[floor_meshes[i].Faces[j].A],
                floor_meshes[i].Vertices[floor_meshes[i].Faces[j].B],
                floor_meshes[i].Vertices[floor_meshes[i].Faces[j].C],
                floor_meshes[i].Vertices[floor_meshes[i].Faces[j].D],
                floor_meshes[i].Vertices[floor_meshes[i].Faces[j].A]

                });


              stair_outlines.Add(bottom_rect);

              //Rhino.RhinoApp.WriteLine((stair_line.ClosestPoint(floor_meshes_face_centers[i][j], false).DistanceTo(floor_meshes_face_centers[i][j]) ).ToString());

              break;
            }
          }

        }



      }
    }

    public void get_ramp(){

    }

    public void get_hand_rails(){

    }

    public void get_slabs(){
      // strips and strip splits
    }

    public void get_columns_beams_diagonals_slabs(){

    }



  }


  DataTree<Line> get_columns(DataTree<Polyline> _axes, Mesh _volume){


    /////////////////////////////////////////////////////////////////////////////////////////////////////////////////////////////////////////////
    // get number of floors the column is finished
    /////////////////////////////////////////////////////////////////////////////////////////////////////////////////////////////////////////////

    int[][] beam_heights = new int[_axes.Branch(0).Count][];
    //iterate floors
    for(int i = 0; i < _axes.Branch(0).Count; i++){
      beam_heights[i] = new int[_axes.Branch(0)[i].Count];
    }


    //iterate floors
    for(int i = 0; i < _axes.BranchCount;i++){

      //iterate polylines
      for(int j = 0; j < _axes.Branch(i).Count ; j++){//skip the last

        //iterate polyline points
        for(int k = 0; k < _axes.Branch(i)[j].Count ; k++){//skip the last

          Point3d center = _axes[new GH_Path(i), j][k];
          if(!_volume.IsPointInside(center, 0.01, true))
            continue;

          beam_heights[j][k] = i;

        }
      }
    }

    /////////////////////////////////////////////////////////////////////////////////////////////////////////////////////////////////////////////
    // create column
    /////////////////////////////////////////////////////////////////////////////////////////////////////////////////////////////////////////////
    DataTree<Line> columns = new DataTree<Line>();

    //iterate one floor
    for(int i = 0; i < 1; i++){

      //iterate polylines
      for(int j = 0; j < _axes.Branch(i).Count ; j++){//skip the last

        // the columns are movec along the axes
        Vector3d move_vec = _axes.Branch(i)[j][1] - _axes.Branch(i)[j][0];
        Line line = new Line(_axes.Branch(i)[j][0], _axes.Branch(i)[j][1]);

        // Rhino.RhinoDoc.ActiveDoc.Objects.AddPolyline(_axes.Branch(i)[j] );
        // Rhino.RhinoDoc.ActiveDoc.Objects.AddLine(line);
        move_vec.Unitize();
        move_vec *= 0.45 * 0.5 + 0.3 * 0.5;

        //iterate polyline points
        for(int k = 0; k < _axes.Branch(i)[j].Count; k++){//skip the last

          int id = beam_heights[j][k];

          // main column

          Line column = new Line(_axes[new GH_Path(i), j][k], _axes[new GH_Path(id), j][k]);

          // side column 1 | move vector is the axis line
          Line column_moved_0 = column;
          column_moved_0.Transform(Transform.Translation(move_vec));

          // side column 2
          Line column_moved_1 = column;
          column_moved_1.Transform(Transform.Translation(-move_vec));



          columns.Add(column, new GH_Path(0));
          //          columns.Add(column_moved_0, new GH_Path(1));
          //          columns.Add(column_moved_1, new GH_Path(1));


        }
      }
    }


    /////////////////////////////////////////////////////////////////////////////////////////////////////////////////////////////////////////////
    // create side columns
    /////////////////////////////////////////////////////////////////////////////////////////////////////////////////////////////////////////////
    double height = 4.6;
    double radius = 0.2;
    double[] heights = new double[]{
      0.5,
      5 - (5 - height) ,
      5 - (5 - height) + radius ,
      10 - (5 - height)};

    //iterate one floor
    for(int i = 0; i < 2; i++){

      //iterate polylines
      for(int j = 0; j < _axes.Branch(i).Count ; j++){//skip the last

        // the columns are movec along the axes
        Vector3d move_vec = _axes.Branch(i)[j][1] - _axes.Branch(i)[j][0];
        Line line = new Line(_axes.Branch(i)[j][0], _axes.Branch(i)[j][1]);






        // Rhino.RhinoDoc.ActiveDoc.Objects.AddPolyline(_axes.Branch(i)[j] );
        // Rhino.RhinoDoc.ActiveDoc.Objects.AddLine(line);
        move_vec.Unitize();
        move_vec *= 0.45 * 0.5 + 0.3 * 0.5;

        //iterate polyline points
        for(int k = 0; k < _axes.Branch(i)[j].Count; k++){//skip the last

          int id = beam_heights[j][k];



          // main column

          Line column = new Line(_axes[new GH_Path(i), j][k], _axes[new GH_Path(id), j][k]);

          if(!_volume.IsPointInside(column.PointAt(1.0), 0.01, true))
            continue;

          Plane plane_0 = new Plane(new Point3d(0, 0, heights[i * 2]), Vector3d.ZAxis);
          Plane plane_1 = new Plane(new Point3d(0, 0, heights[i * 2 + 1]), Vector3d.ZAxis);
          column = new Line (NGonsCore.PlaneUtil.LinePlane(column, plane_0), NGonsCore.PlaneUtil.LinePlane(column, plane_1));

          // side column 1 | move vector is the axis line
          Line column_moved_0 = column;
          column_moved_0.Transform(Transform.Translation(move_vec));

          // side column 2
          Line column_moved_1 = column;
          column_moved_1.Transform(Transform.Translation(-move_vec));



          //columns.Add(column, new GH_Path(0));
          columns.Add(column_moved_0, new GH_Path(1));
          columns.Add(column_moved_1, new GH_Path(1));


        }
      }
    }


    return columns;
  }
# ---------- end c_script ----------
cluster = Cluster_7(L=c_script.output_slab, L_2=c_script.output_slab_beams)  # disabled
cluster_2 = Cluster_9(C=c_script.B)
crv_4 = Curve(c_script.output_dark_green_beam_secondary)  # disabled
cluster_3 = Cluster_8(G=crv_4)  # disabled
group = Group(Objects=c_script.output_vertical_lines)
crv_5 = Curve(c_script.output_diagonals)
number_slider_3 = Slider(20, range=0..100)
swatch = ColourSwatch(SwatchColor=RGB(255, 0, 0))

crv_6 = Curve(c_script.output_slab)  # disabled
area = Area(Geometry=crv_6)  # -> Area, Centroid; disabled
item_3 = ListItem(List=crv_6, Index=0, Wrap=True)  # disabled
explode = Explode(Curve=item_3, Recursive=True)  # -> Segments, Vertices; disabled
item_4 = ListItem(List=explode.Segments, Index=1, Wrap=True)  # disabled
item_5 = ListItem(List=explode.Segments, Index=3, Wrap=True)  # disabled
range = Range(Domain=Domain(0, 1), Steps=3)  # disabled
flip = FlipCurve(Curve=item_4, Guide=item_5)  # -> Curve, Flag; disabled
tweencrv = TweenCurve(CurveA=flip.Curve, CurveB=item_5, Factor=range, BlendType=0)  # disabled
display = CurvePreview(Curve=[item_4, item_5], Width=number_slider_3, Colour=swatch)  # disabled
cull_i = CullIndex(List=tweencrv, Indices=[0, -1], Wrap=True)  # disabled
cluster_4 = Cluster_8(G=cull_i)  # disabled

# ---- group: mesh normals are made as axes
mesh_2 = Mesh(c_script.floor_meshes)
demesh = DeconstructMesh(Mesh=mesh_2)  # -> Vertices, Faces, Colours, Normals
vdis = VectorDisplay(Anchor=demesh.Vertices, Vector=demesh.Normals)

# ----
faceb = FaceBoundaries(Mesh=mesh_2)
item_6 = ListItem(List=faceb, Index=0, Wrap=True)  # -> Item, Item1
item_7 = ListItem(List=flatten(group), Index=Slider(4, range=0..10), Wrap=True)
ungroup = Ungroup(Group=item_7)
crv_7 = Curve(c_script.output_vertical_lines)
midpt = CurveMiddle(Curve=ungroup)
branch = TreeBranch(Tree=c_script.columns, Path="{0}", MaintainPaths=True)
display_2 = CurvePreview(Curve=crv_5, Width=number_slider_3, Colour=swatch)
branch_2 = TreeBranch(Tree=c_script.columns, Path="{1}", MaintainPaths=True)
points = PointList(Points=midpt, Size=Slider(2, range=0..10))
swatch_2 = ColourSwatch(SwatchColor=RGB(255, 255, 255))
swatch_3 = ColourSwatch(SwatchColor=RGB(59, 59, 59))
swatch_4 = ColourSwatch(SwatchColor=RGB(60, 66, 52))
swatch_5 = ColourSwatch(SwatchColor=RGB(229, 255, 0))
swatch_6 = ColourSwatch(SwatchColor=RGB(0, 120, 116))
swatch_7 = ColourSwatch(SwatchColor=RGB(38, 66, 0))
c_script_2 = CSharpScript()  # -> out, A, B, C; inputs x: Mesh
# ---------- c_script_2: C# ----------
    DataTree<int> dt = new DataTree<int>();
    for(int i = 0; i < x.Faces.Count; i++){
      dt.AddRange(x.TopologyEdges.GetEdgesForFace(i), new GH_Path(i));
    }

    A = dt;
    B = x.TopologyEdges.Count;
    C = new Line[]{x.TopologyEdges.EdgeLine(x.TopologyEdges.GetEdgesForFace(3)[0])};
# ---------- end c_script_2 ----------
display_3 = CurvePreview(Curve=c_script_2.C, Width=10)
cluster_5 = Cluster_3(T=branch_2, R=0.15, M=swatch_3)  # -> M_2, T_2
cluster_6 = Cluster_2(T=branch, R=0.225, C=swatch_2)  # -> M, T_2
cluster_7 = Cluster(T=c_script.output_dark_green_beam, R=0.2, C=swatch_4)  # -> M, T_2
cluster_8 = Cluster(T=c_script.B, R=0.2, C=swatch_5)  # -> M, T_2
cluster_9 = Cluster(T=c_script.output_dark_green_beam_secondary, R=0.2, C=swatch_7)  # -> M, T_2
cluster_10 = Cluster_6(T=c_script.output_diagonals, R=0.2, C=swatch_6, A=Slider(0.4, range=0..1))  # -> M, T_2
cluster_11 = Cluster_4(L=c_script.output_slab)
cluster_12 = Cluster_5(L=c_script.output_slab_beams)
txt = Text(c_script.out)
panel = Panel(txt)
number_slider_4 = Slider(0.001, range=0..0.001)  # disabled

# ---- group: Tragkonstruktion_
brep_3 = Brep([<brep referenced from the Rhino model> x1490])  # disabled
debrep = DeconstructBrep(Brep=brep_3)  # -> Faces, Edges, Vertices; disabled
area_2 = Area(Geometry=debrep.Faces)  # -> Area, Centroid; disabled
sort = SortList(Keys=area_2.Area)  # -> reverse(Keys), ValuesA; disabled
item_8 = ListItem(List=sort.Keys, Index=0, Wrap=True)  # -> flatten(Item); disabled
volume = Volume(Geometry=brep_3)  # -> Volume, Centroid; disabled
lng = ListLength(List=brep_3)  # disabled

# ---- group: Tragkonstruktion_ / Trio beams
brep_4 = Brep([<brep referenced from the Rhino model> x2060])  # disabled
edges = BrepEdges(Brep=brep_4)  # -> Naked, Interior, NonManifold; disabled
len = Length(Curve=edges.Interior)  # disabled
sort_2 = SortList(Keys=len)  # -> reverse(Keys), ValuesA; disabled
lng_2 = ListLength(List=brep_4)  # disabled
item_9 = ListItem(List=sort_2.Keys, Index=0, Wrap=True)  # -> flatten(Item); disabled
volume_2 = Volume(Geometry=brep_4)  # -> Volume, Centroid; disabled

# ---- group: Tragkonstruktion_
clean = CleanTree(RemoveNulls=True, RemoveInvalid=True, RemoveEmpty=invert(False), Tree=cluster_6.T_2)  # -> flatten(Tree)
clean_2 = CleanTree(RemoveNulls=True, RemoveInvalid=True, RemoveEmpty=invert(False), Tree=cluster_5.T_2)  # -> flatten(Tree)
clean_3 = CleanTree(RemoveNulls=True, RemoveInvalid=True, RemoveEmpty=invert(False), Tree=cluster_8.T_2)  # -> flatten(Tree)
clean_4 = CleanTree(RemoveNulls=True, RemoveInvalid=True, RemoveEmpty=invert(False), Tree=cluster_7.T_2)  # -> flatten(Tree)
clean_5 = CleanTree(RemoveNulls=True, RemoveInvalid=True, RemoveEmpty=invert(False), Tree=cluster_9.T_2)  # -> flatten(Tree)
clean_6 = CleanTree(RemoveNulls=True, RemoveInvalid=True, RemoveEmpty=invert(False), Tree=cluster_10.T_2)  # -> flatten(Tree)
len_2 = Length(Curve=clean)
len_3 = Length(Curve=clean_2)
len_4 = Length(Curve=clean_3)
len_5 = Length(Curve=clean_4)
len_6 = Length(Curve=clean_5)
len_7 = Length(Curve=clean_6)
lng_3 = ListLength(List=len_2)
lng_4 = ListLength(List=len_3)
lng_5 = ListLength(List=len_4)
lng_6 = ListLength(List=len_5)
lng_7 = ListLength(List=len_6)
lng_8 = ListLength(List=len_7)
entwine = Entwine(Branch00=lng_3, Branch01=lng_4, Branch02=lng_5, Branch03=lng_6, Branch04=lng_7, Branch05=lng_8, FlattenInputs=True)  # -> simplify(Result)
panel_2 = Panel("""N Spalte_45 (d | N | m3 | m2)
N Spalte_30(d | N | m3 | m2)
N Balken_40_hellgrün (d | N | m3 | m2)
N Balken_40_dunkelgrün_A (d | N | m3 | m2)
N Balken_40_dunkelgrün_B (d | N | m3 | m2)
N Diagonalen_40 (d | N | m3 | m2)""")
entwine_2 = Entwine(Branch00=len_2, Branch01=len_3, Branch02=len_4, Branch03=len_5, Branch04=len_6, Branch05=len_7, FlattenInputs=True)  # -> simplify(Result)
ma = MassAddition(Input=entwine_2)  # -> Result, PartialResults
c_script_3 = CSharpScript(x=entwine_2)  # -> out, A; inputs x: Double
# ---------- c_script_3: C# ----------
    A = Math.Round(x, 2).ToString();
# ---------- end c_script_3 ----------
panel_3 = Panel("""0.45
0.30
0.40
0.40
0.40
0.40""")
panel_4 = Panel("""Länge (m)
Länge (m)
Länge (m)
Länge (m)
Länge (m)
Länge (m)""")
graft = GraftTree(Tree=panel_3, IncludeEmptyLists=True, IncludeNullItems=True)  # -> simplify(Tree)
graft_2 = GraftTree(Tree=panel_2, IncludeEmptyLists=True, IncludeNullItems=True)  # -> simplify(Tree)
toggle = BooleanToggle(False)
c_script_4 = CSharpScript(l=simplify(ma.Result), d=simplify(graft))  # -> out, A; inputs l: Double, d: Double
# ---------- c_script_4: C# ----------
    double cylinde_volume = Math.PI * Math.Pow((d / 2), 2) * l;
    
    A = Math.Round(cylinde_volume, 2).ToString();
# ---------- end c_script_4 ----------
graft_3 = GraftTree(Tree=panel_4, IncludeEmptyLists=True, IncludeNullItems=True)  # -> simplify(Tree)
merge = Merge(Data1=graft_2, Data2=graft, Data3=entwine, Data4=c_script_4.A, Data5=graft_3, Data6=c_script_3.A)  # -> simplify(Result)
path = FilePath("C:\IBOIS57\_Code\Software\Phanomena\phanomena\calculation\main_building_grid.xlsx")
pssimplewritetable = SimpleWriteTreeToXLS(
    File=path,
    SheetIdentifier="Tragkonstruktion",
    Data=merge,
    RowFirst=invert(True),
    ResizeColumn=True,
    CreateNew=toggle,
    IgnoreNull=invert(False),
    OK=toggle)

# ----
panel_5 = Panel(lng_7)
panel_6 = Panel(lng_6)

# ---- group: Tragkonstruktion_
entwine_3 = Entwine(Branch00=volume_2.Volume, Branch01=volume.Volume, FlattenInputs=True)  # -> simplify(Result); disabled
entwine_4 = Entwine(Branch00=lng_2, Branch01=lng, FlattenInputs=True)  # -> simplify(Result); disabled
entwine_5 = Entwine(Branch00=item_9, Branch01=item_8, FlattenInputs=True)  # -> simplify(Result); disabled
panel_7 = Panel("""N Trio_0.12_0.28 (d | N | m3 | m)
N CLT_0.042 (d | N | m3 | m2)""")  # disabled
ma_2 = MassAddition(Input=entwine_3)  # -> Result, PartialResults; disabled
c_script_5 = CSharpScript(x=entwine_5)  # -> out, A; inputs x: Double; disabled; same code as c_script_3
panel_8 = Panel("""0.12 x 0.28
0.042""")  # disabled
panel_9 = Panel("""Länge (m)
Fläche eines Panels (m2)""")  # disabled
graft_4 = GraftTree(Tree=panel_8, IncludeEmptyLists=True, IncludeNullItems=True)  # -> simplify(Tree); disabled
graft_5 = GraftTree(Tree=panel_7, IncludeEmptyLists=True, IncludeNullItems=True)  # -> simplify(Tree); disabled
graft_6 = GraftTree(Tree=panel_9, IncludeEmptyLists=True, IncludeNullItems=True)  # -> simplify(Tree); disabled
toggle_2 = BooleanToggle(True)  # disabled
merge_2 = Merge(Data1=graft_5, Data2=graft_4, Data3=entwine_4, Data4=ma_2.Result, Data5=graft_6, Data6=c_script_5.A)  # -> simplify(Result); disabled
panel_10 = Panel("Tragkonstruktion")  # disabled
path_2 = FilePath("C:\IBOIS57\_Code\Software\Phanomena\phanomena\calculation\main_building_grid_floor.xlsx")  # disabled
panel_11 = Panel(path_2)  # disabled
pssimplewritetable_2 = SimpleWriteTreeToXLS(
    File=path_2,
    SheetIdentifier=panel_10,
    Data=merge_2,
    RowFirst=invert(True),
    ResizeColumn=True,
    CreateNew=toggle_2,
    IgnoreNull=invert(False),
    OK=toggle_2)  # disabled

# ----
data = Data([swatch_2, swatch_3, swatch_5, swatch_4, swatch_7, swatch_6])
entwine_6 = Entwine(
    Branch00=flatten(cluster_6.T_2),
    Branch01=flatten(cluster_5.T_2),
    Branch02=flatten(cluster_8.T_2),
    Branch03=flatten(cluster_7.T_2),
    Branch04=flatten(cluster_9.T_2),
    Branch05=flatten(cluster_10.T_2),
    FlattenInputs=True)  # -> simplify(Result)
panel_12 = Panel("""Lines_Tragkonstruktion_Spalte_45 (m)
Lines_Tragkonstruktion_Spalte_30(m)
Lines_Tragkonstruktion_Balken_40_hellgrün (m)
Lines_Tragkonstruktion_Balken_40_dunkelgrün_A (m)
Lines_Tragkonstruktion_Balken_40_dunkelgrün_B (m)
Lines_Tragkonstruktion_Diagonalen_40 (m)""")
toggle_3 = BooleanToggle(False)
bake = ObjectBake(
    BakeToggle=toggle_3,
    GeometryObjects=entwine_6,
    Layer=graft(panel_12),
    ObjectName="GH_Obj",
    ObjectColor=graft(data),
    LayerColor=graft(data))

data_2 = Data([swatch_2, swatch_3, swatch_5, swatch_4, swatch_7, swatch_6])
panel_13 = Panel("""Tragkonstruktion_Spalte_45 (m)
Tragkonstruktion_Spalte_30(m)
Tragkonstruktion_Balken_40_hellgrün (m)
Tragkonstruktion_Balken_40_dunkelgrün_A (m)
Tragkonstruktion_Balken_40_dunkelgrün_B (m)
Tragkonstruktion_Diagonalen_40 (m)""")
entwine_7 = Entwine(
    Branch00=flatten(cluster_6.M),
    Branch01=flatten(cluster_5.M_2),
    Branch02=flatten(cluster_8.M),
    Branch03=flatten(cluster_7.M),
    Branch04=flatten(cluster_9.M),
    Branch05=flatten(cluster_10.M),
    FlattenInputs=True)  # -> simplify(Result)
bake_2 = ObjectBake(
    BakeToggle=toggle_3,
    GeometryObjects=entwine_7,
    Layer=graft(panel_13),
    ObjectName="GH_Obj",
    ObjectColor=graft(data_2),
    LayerColor=graft(data_2))

panel_14 = Panel(path)

# ---- group: Stairs
brep_5 = Brep([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])  # disabled
brep_6 = Brep([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])  # disabled
crv_8 = Curve([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])  # disabled
crv_9 = Curve([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])  # disabled

# ---- group: Stairs / Stairs sub structure
morph = BoxMorph(Geometry=crv_9, Reference=tbox_2, Target=tbox)  # disabled
number_slider_5 = Slider(2, range=0..10)  # disabled
line = Line(morph)  # disabled
number_slider_6 = Slider(125, range=0..1000)  # disabled
number_slider_7 = Slider(150, range=0..1000)  # disabled
split = SplitList(List=line, Index=number_slider_5)  # -> ListA, ListB; disabled
pipe = Pipe(Curve=split.ListA, Radius=number_slider_7, Caps=flatten(1))  # -> simplify(Pipe); disabled
pipe_2 = Pipe(Curve=split.ListB, Radius=number_slider_6, Caps=flatten(1))  # -> simplify(Pipe); disabled
trim_2 = TrimTree(Tree=[pipe, pipe_2], Depth=1)  # disabled
sunion = SolidUnion(Breps=trim_2)  # -> graft(Result); disabled

# ---- group: Stairs / Handrail
morph_2 = BoxMorph(Geometry=brep_5, Reference=tbox_2, Target=tbox)  # disabled

# ---- group: Stairs / Steps
morph_3 = BoxMorph(Geometry=brep_6, Reference=tbox_2, Target=tbox)  # -> simplify(graft(Geometry)); disabled
morph_4 = BoxMorph(Geometry=crv_8, Reference=tbox_2, Target=tbox)  # disabled
number_slider_8 = Slider(180, range=0..1000)  # disabled
ext = ExtendCurve(Curve=morph_4, Type=0, Start=1000, End=1000)  # disabled
line_2 = Line(ext)  # disabled
pipe_3 = Pipe(Curve=line_2, Radius=number_slider_8, Caps=1)  # -> simplify(Pipe); disabled
sint = SolidIntersection(BrepsA=morph_3, BrepsB=pipe_3)  # disabled

# ---- group: Stairs (continued)
trim_3 = TrimTree(Tree=sint, Depth=1)  # disabled
group_2 = Group(Objects=[morph_2, trim_3])  # disabled
group_3 = Group(Objects=group_2)  # disabled

# ----
scale_2 = Scale(Geometry=group_3, Center=Point(0, 0, 0), Factor=number_slider_4)  # -> Geometry, Transform; disabled

# ==== cluster Cluster
R = ClusterInput()
T = ClusterInput()
clean = CleanTree(RemoveNulls=True, RemoveInvalid=True, RemoveEmpty=invert(False), Tree=T)
meshpipe = MeshPipe(Curve=clean, Radius=R, Sides=10, Tolerance=10, Ending=0)
C = ClusterInput()
swatch = ColourSwatch(SwatchColor=RGB(255, 255, 255))
colormesh = ColorMesh(Mesh=meshpipe, Color=C)
preview = CustomPreview(
    Geometry=flatten(meshpipe),
    Material=flatten({diffuse=RGB(221, 160, 221), emission=RGB(66, 48, 66), shine=0.5, specular=RGB(255, 255, 255), transparency=0}))
M = ClusterOutput(colormesh)
T_2 = ClusterOutput(clean)
meshedges = MeshEdges(Mesh=colormesh)  # -> AllE, NakedE
display = CurvePreview(Curve=meshedges.AllE, Width=Slider(1, range=0..1))

# ==== cluster Cluster_2
R = ClusterInput()
T = ClusterInput()
clean = CleanTree(RemoveNulls=True, RemoveInvalid=True, RemoveEmpty=invert(False), Tree=T)
meshpipe = MeshPipe(Curve=clean, Radius=R, Sides=10, Tolerance=10, Ending=0)
C = ClusterInput()
colormesh = ColorMesh(Mesh=meshpipe, Color=C)
meshedges = MeshEdges(Mesh=colormesh)  # -> AllE, NakedE
T_2 = ClusterOutput(clean)
M = ClusterOutput(colormesh)
display = CurvePreview(Curve=meshedges.AllE, Width=Slider(1, range=0..1))

# ==== cluster Cluster_3
R = ClusterInput()
T = ClusterInput()
clean = CleanTree(RemoveNulls=True, RemoveInvalid=True, RemoveEmpty=invert(False), Tree=T)
lng = ListLength(List=clean)
wheel = ColourWheel(
    lng,
    ColourGrips_Style=10,
    ColourGrips_Grip=[1.060050173, 2.094395102, 4.188790205, 3.141592654],
    ColourGrips_Lum=[0.1, 0.6014165268],
    ColourGrips_Range=[0.4092652311, 0.4092652311, 0.4092652311, 0.4092652311],
    ColourGrips_Sat=[0, 0.3603819476])
M = ClusterInput()
meshpipe = MeshPipe(Curve=clean, Radius=R, Sides=10, Tolerance=10, Ending=0)
colormesh = ColorMesh(Mesh=meshpipe, Color=wheel)
T_2 = ClusterOutput(clean)
M_2 = ClusterOutput(colormesh)
meshedges = MeshEdges(Mesh=colormesh)  # -> AllE, NakedE
display = CurvePreview(Curve=meshedges.AllE, Width=Slider(1, range=0..1))

# ==== cluster Cluster_4
L = ClusterInput()
partition = PartitionList(List=L, Size=2)
fromp = FromPolylines(Curves=L, Min_Triangulation=False)
loft = LoftPolylines(Curve0=partition, Fast=invert(True))
meshedges = MeshEdges(Mesh=fromp)  # -> AllE, NakedE
colormesh = ColorMesh(Mesh=loft, Color=ColourSwatch(SwatchColor=RGBA(209, 188, 140, 141)))
display = CurvePreview(Curve=meshedges.AllE)

# ==== cluster Cluster_5
L = ClusterInput()
partition = PartitionList(List=L, Size=2)
loft = LoftPolylines(Curve0=partition, Fast=invert(True))
meshedges = MeshEdges(Mesh=loft)  # -> AllE, NakedE
colormesh = ColorMesh(Mesh=loft, Color=ColourSwatch(SwatchColor=RGB(209, 188, 140)))
display = CurvePreview(Curve=meshedges.AllE)

# ==== cluster Cluster_6
R = ClusterInput()
T = ClusterInput()
clean = CleanTree(RemoveNulls=True, RemoveInvalid=True, RemoveEmpty=invert(False), Tree=T)
line = Line(clean)
Z = UnitZ(Factor=1)
vec = Vector(line)
A = ClusterInput()
xprod = CrossProduct(VectorA=vec, VectorB=Z, Unitize=False)  # -> Vector, Length
amp = Amplitude(Vector=xprod.Vector, Amplitude=A)
move = Move(Geometry=clean, Motion=amp)  # -> Geometry, Transform
meshpipe = MeshPipe(Curve=clean, Radius=R, Sides=10, Tolerance=10, Ending=0)
C = ClusterInput()
swatch = ColourSwatch(SwatchColor=RGB(255, 255, 255))
colormesh = ColorMesh(Mesh=meshpipe, Color=C)
preview = CustomPreview(
    Geometry=flatten(meshpipe),
    Material=flatten({diffuse=RGB(221, 160, 221), emission=RGB(66, 48, 66), shine=0.5, specular=RGB(255, 255, 255), transparency=0}))
M = ClusterOutput(colormesh)
T_2 = ClusterOutput(clean)
meshedges = MeshEdges(Mesh=colormesh)  # -> AllE, NakedE
display = CurvePreview(Curve=meshedges.AllE, Width=Slider(1, range=0..1))

# ==== cluster Cluster_7
L = ClusterInput()
L_2 = ClusterInput()
partition = PartitionList(List=L, Size=2)
loft = Loft(Curves=partition, Options={Adjust=False, Closed=False, LoftEnds=0, LoftSimp=0, LoftType=0, Rebuild=10, Refit=0.01})
partition_2 = PartitionList(List=L_2, Size=2)
cap = CapHoles(Brep=loft)  # -> simplify(Brep)
loft_2 = Loft(Curves=partition_2, Options={Adjust=False, Closed=False, LoftEnds=0, LoftSimp=0, LoftType=0, Rebuild=10, Refit=0.01})
cap_2 = CapHoles(Brep=loft_2)  # -> simplify(Brep)
trim = TrimTree(Tree=cap_2, Depth=1)
group = Group(Objects=[cap, trim])
G = ClusterOutput(group)
panel = Panel(cap)

# ==== cluster Cluster_8
panel = Panel("""-1
1""")
number_slider = Slider(0, range=0..10)
G = ClusterInput()
Z = UnitZ(Factor=panel)
move = Move(Geometry=graft(G), Motion=Z)  # -> Geometry, Transform
ext = ExtendCurve(Curve=move.Geometry, Type=0, Start=number_slider, End=number_slider)
loft = Loft(Curves=ext, Options={Adjust=False, Closed=False, LoftEnds=0, LoftSimp=0, LoftType=0, Rebuild=10, Refit=0.01})
L = ClusterOutput(loft)

# ==== cluster Cluster_9
C = ClusterInput()
len = Length(Curve=C)
larger = LargerThan(FirstNumber=len, SecondNumber=7.5)  # -> LargerThan, OrEqualTo
cull = CullPattern(List=C, CullPattern=larger.LargerThan)
display = CurvePreview(Curve=cull, Width=Slider(27, range=0..1000))
