# Grasshopper definition Restaurant structure generation.ghx (Grasshopper 1.0.7)

crv = Curve([<curve referenced from the Rhino model> x96])  # disabled
crv_2 = Curve([<curve referenced from the Rhino model> x48])  # disabled
crv_3 = Curve([<curve referenced from the Rhino model> x42])  # disabled
crv_4 = Curve([<curve referenced from the Rhino model> x23])  # disabled
pipe = Pipe(Curve=crv_2, Radius=250, Caps=1)
midpt = CurveMiddle(Curve=crv_4)
midpt_2 = CurveMiddle(Curve=crv_3)
midpt_3 = CurveMiddle(Curve=crv)
pipe_2 = Pipe(Curve=crv, Radius=200, Caps=1)
scale = Scale(Geometry=crv_4, Center=midpt, Factor=1.1)  # -> Geometry, Transform
scale_2 = Scale(Geometry=crv_3, Center=midpt_2, Factor=1.1)  # -> Geometry, Transform
scale_3 = Scale(Geometry=crv, Center=midpt_3, Factor=0.9)  # -> Geometry, Transform
pipe_3 = Pipe(Curve=scale.Geometry, Radius=200, Caps=1)
pipe_4 = Pipe(Curve=scale_2.Geometry, Radius=200, Caps=1)
end = EndPoints(Curve=scale_3.Geometry)  # -> Start, End
shift = ShiftList(List=end.End, Shift=1, Wrap=True)
shift_2 = ShiftList(List=end.Start, Shift=1, Wrap=True)
ln = Line(StartPoint=end.Start, EndPoint=shift_2)
ln_2 = Line(StartPoint=end.End, EndPoint=shift)
cull = CullPattern(
    List=ln_2,
    CullPattern=[False, True, False, True, False, True, False, True, False, True, False, True, False, True, False, False])
cull_2 = CullPattern(
    List=ln,
    CullPattern=[False, True, False, True, False, True, False, True, False, True, False, True, False, True, False, False])
move = Move(Geometry=cull_2, Motion=Vector(0, 0, 400))  # -> Geometry, Transform
move_2 = Move(Geometry=cull, Motion=Vector(0, 0, 400))  # -> Geometry, Transform
midpt_4 = CurveMiddle(Curve=move.Geometry)
midpt_5 = CurveMiddle(Curve=move_2.Geometry)
scale_4 = Scale(Geometry=move.Geometry, Center=midpt_4, Factor=1.1)  # -> Geometry, Transform
scale_5 = Scale(Geometry=move_2.Geometry, Center=midpt_5, Factor=1.1)  # -> Geometry, Transform
line = Line(scale_5.Geometry)
line_2 = Line(scale_4.Geometry)
pipe_5 = Pipe(Curve=[line_2, line], Radius=200, Caps=1)
shift_3 = ShiftList(List=line_2, Shift=7, Wrap=False)
cull_i = CullIndex(List=line, Indices=[35, 36, 37, 38, 39, 40, 41], Wrap=True)
dispatch = Dispatch(List=cull_i, DispatchPattern=[True, False, False, False, False, False, True])  # -> ListA, ListB
dispatch_2 = Dispatch(List=shift_3, DispatchPattern=[True, False, False, False, False, False, True])  # -> ListA, ListB
divide = DivideCurve(Curve=dispatch.ListA, Count=16, Kinks=False)  # -> simplify(Points), Tangents, Parameters
divide_2 = DivideCurve(Curve=dispatch_2.ListA, Count=16, Kinks=False)  # -> simplify(Points), Tangents, Parameters
divide_3 = DivideCurve(Curve=dispatch.ListB, Count=8, Kinks=False)  # -> Points, Tangents, Parameters
divide_4 = DivideCurve(Curve=dispatch_2.ListB, Count=8, Kinks=False)  # -> Points, Tangents, Parameters

# ---- group: Creates the beams
ln_3 = Line(StartPoint=divide_2.Points, EndPoint=divide.Points)  # -> simplify(Line)
ln_4 = Line(StartPoint=divide_4.Points, EndPoint=divide_3.Points)  # -> simplify(Line)
midpt_6 = CurveMiddle(Curve=ln_4)
midpt_7 = CurveMiddle(Curve=ln_3)
scale_6 = Scale(Geometry=ln_4, Center=midpt_6, Factor=1.05)  # -> Geometry, Transform
scale_7 = Scale(Geometry=ln_3, Center=midpt_7, Factor=1.05)  # -> Geometry, Transform
culln = CullNth(List=scale_7.Geometry, CullFrequency=17)
culln_2 = CullNth(List=scale_6.Geometry, CullFrequency=9)
move_3 = Move(Geometry=[culln, culln_2], Motion=Vector(0, 0, 200))  # -> Geometry, Transform
extr = Extrude(Base=move_3.Geometry, Direction=Vector(0, 0, 280))
area = Area(Geometry=extr)  # -> Area, Centroid
evalsrf = EvaluateSurface(Surface=extr, Point=area.Centroid)  # -> Point, Normal, UDirection, VDirection, Frame
devec = DeconstructVector(Vector=evalsrf.Normal)  # -> XComponent, YComponent, ZComponent
devec_2 = DeconstructVector(Vector=evalsrf.Normal)  # -> XComponent, YComponent, ZComponent
multiplication = Multiplication(A=devec.XComponent, B=120)
multiplication_2 = Multiplication(A=devec.YComponent, B=120)
multiplication_3 = Multiplication(A=devec_2.XComponent, B=-200)
multiplication_4 = Multiplication(A=devec_2.YComponent, B=-200)
vec = VectorXYZ(XComponent=multiplication, YComponent=multiplication_2, ZComponent=0)  # -> Vector, Length
vec_2 = VectorXYZ(XComponent=multiplication_3, YComponent=multiplication_4, ZComponent=0)  # -> Vector, Length
extr_2 = Extrude(Base=extr, Direction=vec.Vector)
move_4 = Move(Geometry=extr_2, Motion=vec_2.Vector)  # -> Geometry, Transform
partition = PartitionList(List=move_4.Geometry, Size=4)
group = Group(Objects=partition)  # -> flatten(Group)

# ---- group: Generates the plates
cull_3 = CullPattern(List=divide_3.Points, CullPattern=[True, False, False, False])
cull_4 = CullPattern(List=divide_4.Points, CullPattern=[True, False, False, False])
cull_5 = CullPattern(List=divide.Points, CullPattern=[True, False, False, False])
cull_6 = CullPattern(List=divide_2.Points, CullPattern=[True, False, False, False])
item = ListItem(List=cull_3, Index=[0, 1], Wrap=True)  # -> reverse(Item)
item_2 = ListItem(List=cull_4, Index=[1, 2], Wrap=True)
item_3 = ListItem(List=cull_5, Index=[0, 1], Wrap=True)  # -> reverse(Item)
item_4 = ListItem(List=cull_3, Index=[1, 2], Wrap=True)  # -> reverse(Item)
item_5 = ListItem(List=cull_6, Index=[1, 2], Wrap=True)
item_6 = ListItem(List=cull_5, Index=[1, 2], Wrap=True)  # -> reverse(Item)
item_7 = ListItem(List=cull_6, Index=[2, 3], Wrap=True)
item_8 = ListItem(List=cull_5, Index=[2, 3], Wrap=True)  # -> reverse(Item)
item_9 = ListItem(List=cull_6, Index=[3, 4], Wrap=True)
item_10 = ListItem(List=cull_5, Index=[3, 4], Wrap=True)  # -> reverse(Item)
item_11 = ListItem(List=cull_4, Index=[0, 1], Wrap=True)
item_12 = ListItem(List=cull_6, Index=[0, 1], Wrap=True)
pline = PolyLine(Vertices=[item_2, item_4], Closed=True)
pline_2 = PolyLine(Vertices=[item_5, item_6], Closed=True)
pline_3 = PolyLine(Vertices=[item_11, item], Closed=True)
pline_4 = PolyLine(Vertices=[item_12, item_3], Closed=True)
pline_5 = PolyLine(Vertices=[item_9, item_10], Closed=True)
pline_6 = PolyLine(Vertices=[item_7, item_8], Closed=True)
extr_3 = Extrude(Base=[pline_4, pline_2, pline_6, pline_5, pline_3, pline], Direction=Vector(0, 0, 42))
cap = CapHoles(Brep=extr_3)
move_5 = Move(Geometry=cap, Motion=Vector(0, 0, 480))  # -> flatten(Geometry), Transform

# ----
merge = Merge(Data1=simplify(graft(group)), Data2=simplify(graft(move_5.Geometry)))
entwine = Entwine(Branch00=flatten(group), Branch01=flatten(move_5.Geometry), FlattenInputs=True)
item_13 = ListItem(Index=0, Wrap=True)
explode = Explode(Curve=[pline_4, pline_2, pline_6, pline_5, pline_3, pline], Recursive=True)  # -> Segments, Vertices
item_14 = ListItem(List=explode.Segments, Index=[1, 3], Wrap=True)
group_2 = Group(Objects=merge)  # -> flatten(Group)
group_3 = Group(Objects=group_2)
item_15 = ListItem(List=group_2, Index=Slider(0, range=0..100), Wrap=True)
len = Length(Curve=item_14)
sort = SortList(Keys=flatten(item_14), ValuesA=flatten(len))  # -> Keys, ValuesA
panel = Panel(sort.Keys)
